# Grasshopper definition 3d_toolpath_generator.gh (Grasshopper 1.0.7)

number_slider = Slider(0.371, range=0..1)
brep = Brep(<brep referenced from the Rhino model>)
number_slider_2 = Slider(35, range=0..35, expression="x*2")
number_slider_3 = Slider(1, range=0..1)
brep_2 = Brep(<brep referenced from the Rhino model>)
brep_3 = Brep(<brep referenced from the Rhino model>)
contour = Contour(Shape=brep, Point=Point(0, 0, 0), Direction=Vector(0, 0, 1), Distance=Slider(0.5, range=0..1))  # -> flatten(Contours)
number_slider_4 = Slider(13, range=0..100)
number_slider_5 = Slider(9, range=0..10)
brep_4 = Brep(<brep referenced from the Rhino model>)
contour_2 = Contour(Shape=brep_2, Point=Point(0, 0, 0), Direction=Vector(0, 0, 1), Distance=Slider(1, range=0..1))
number_slider_6 = Slider(14, range=0..100)
number_slider_7 = Slider(50, range=0..100)
contour_3 = Contour(Shape=brep_3, Point=Point(0, 0, 0), Direction=Vector(0, 0, 1), Distance=Slider(0.441, range=0..1))
divide = DivideCurve(Curve=contour, Count=number_slider_2, Kinks=False)  # -> flatten(Points), Tangents, Parameters
brep_5 = Brep(<brep referenced from the Rhino model>)
number_slider_8 = Slider(5, range=0..10)
number_slider_9 = Slider(50, range=0..100)
contour_4 = Contour(Shape=brep_4, Point=Point(0, 0, 0), Direction=Vector(0, 0, 1), Distance=number_slider_3)
divide_2 = DivideCurve(Curve=contour_2, Count=number_slider_4, Kinks=False)  # -> Points, Tangents, Parameters
divide_3 = DivideCurve(Curve=contour_3, Count=number_slider_7, Kinks=False)  # -> Points, Tangents, Parameters
contour_5 = Contour(Shape=brep_5, Point=Point(0, 0, 0), Direction=Vector(0, 0, 1), Distance=Slider(1, range=0..1))
c_script = CSharpScript(pts=divide.Points, d=number_slider_2, Contour=contour)  # -> out, A, B; inputs pts: list of Point3d, d: Int32, Contour: list of Curve
# ---------- c_script: C# ----------
    //First Path

    List<Arc> arcs = new List<Arc>();
    for (int j = 0; j < (Contour.Count - 1); j++)
    {
      List<Curve> layers = new List<Curve>();

      if (j % 2 == 0)
      {
        for (int i = j * d; i < (j + 1) * d - 2; i = i + 2)
        {

          Point3d start = pts[i];
          Point3d middle = pts[i + (d + 1)];
          Point3d end = pts[i + 2];
          Arc ac = new Arc(start, middle, end);
          Curve crv = ac.ToNurbsCurve();
          arcs.Add(ac);

        }

        Point3d start1 = pts[(j + 1) * d - 2];
        Point3d middle1 = pts[((j + 2) * d - 1)];
        Point3d end1 = pts[j * d];
        Arc ac2 = new Arc(start1, middle1, end1);
        Curve crv2 = ac2.ToNurbsCurve();
        arcs.Add(ac2);

        //Polyline travel = new Polyline();
        //travel
      }
      //Second Path
      if (j % 2 != 0)
      {
        for (int i = j * d; i < (j + 1) * d - 2; i = i + 2)
        {

          Point3d start = pts[i + d];
          Point3d middle = pts[i + 1];
          Point3d end = pts[i + (d + 2)];
          Arc ac = new Arc(start, middle, end);
          Curve crv = ac.ToNurbsCurve();
          arcs.Add(ac);

        }

        Point3d start1 = pts[(j + 2) * d - 2];
        Point3d middle1 = pts[(j + 1) * d - 1];
        Point3d end1 = pts[(j + 1) * d];
        Arc ac2 = new Arc(start1, middle1, end1);
        Curve crv2 = ac2.ToNurbsCurve();
        arcs.Add(ac2);
      }


    }



    //Second Path



    //Arc bc = new Arc(points[points.Count - 1], vector, points[0]);
    //arcs.Add(bc);
    //Arcs = arcs;
    //pts.Count - d

    //B = arcs_b;
    A = arcs;
# ---------- end c_script ----------
flip = FlipMatrix(Data=divide_2.Points)
divide_4 = DivideCurve(Curve=contour_4, Count=number_slider_9, Kinks=False)  # -> Points, Tangents, Parameters
fr2 = Slider(400, range=0..10000)
flip_2 = FlipMatrix(Data=divide_3.Points)
fr2_2 = Slider(400, range=0..10000)
pline = PolyLine(Vertices=flip, Closed=False)
panel = Panel(divide_4.Points)
subtraction = Subtraction(A=number_slider_9, B=number_slider_8)
pline_2 = PolyLine(Vertices=flip_2, Closed=False)
divide_5 = DivideCurve(Curve=contour_5, Count=Slider(50, range=0..100), Kinks=False)  # -> Points, Tangents, Parameters
explode = Explode(Curve=pline, Recursive=True)  # -> Segments, Vertices
division = Division(A=number_slider_3, B=number_slider_8)
panel_2 = Panel("""; Header Code for Dremel 3D45 Printer
M190 S35
M104 S220
M109 S220
G28
G1 Z50.00 F400
G92 E0
G1 F200 E3
G92 E0
M132 X Y Z A
M907 X100 Y100 Z60 A100
M107""")
explode_2 = Explode(Curve=pline_2, Recursive=True)  # -> Segments, Vertices
c_pattern_to_toolpath = CSharpScript(
    arcs=c_script.A,
    basePts=divide.Points,
    N=number_slider_2,
    x=Slider(6, range=0..10),
    FR1=Slider(100, range=0..10000),
    FR2=fr2,
    travelFR=fr2_2)  # -> out, toolPathsOut, isExtrudingOut, feedRatesOut, PTS; inputs arcs: list of Curve, basePts: list of Point3d, N: Int32, x: Int32, FR1: Int32, FR2: Int32, travelFR: Int32; disabled
# ---------- c_pattern_to_toolpath: C# ----------
    List<Polyline> toolPaths = new List<Polyline>();
    List<bool> isExtruding = new List<bool>();
    List<int> feedRates = new List<int>();

    Polyline basepl = new Polyline();
    for(int i = 0; i < N;i++)
    {
      basepl.Add(basePts[i]);
    }
    basepl.Add(basePts[0]);
    toolPaths.Add(basepl);
    isExtruding.Add(true);
    feedRates.Add(FR2);


    //subdivide curve to points
    List < Point3d > all_pts = new List<Point3d>();
    for(int i = 0; i < arcs.Count;i++)
    {
      List<double> divpara = new List<double>();
      double[] div = arcs[i].DivideByCount(x, true);

      List<Point3d> pts = new List<Point3d>();
      for(int j = 0; j < div.Length ; j++)
      {
        Point3d p = arcs[i].PointAt(div[j]);
        pts.Add(p);

      }
      //connect points to polyline and add to the toolpath
      Polyline pl = new Polyline();
      Polyline travel = new Polyline();

      for(int j = 0; j < pts.Count;j++)
      {
        pl.Add(pts[j]);
        //if(i % N == 0 && j == x - 1) 
        //{
            //pl.Add(pts[j] + 2*Vector3d.ZAxis);
          
        //}

      }
     
      toolPaths.Add(pl);
      isExtruding.Add(true);
      feedRates.Add(FR1);




    }







    toolPathsOut = toolPaths;
    isExtrudingOut = isExtruding;
    feedRatesOut = feedRates;
    PTS = all_pts;
# ---------- end c_pattern_to_toolpath ----------
split = SplitList(List=divide_4.Points, Index=subtraction)  # -> ListA, ListB
end = EndPoints(Curve=explode.Segments)  # -> Start, End
pline_3 = PolyLine(Vertices=flatten(divide_5.Points), Closed=False)
panel_3 = Panel(split.ListA)
series = Series(Start=0, Step=division, Count=number_slider_8)
end_2 = EndPoints(Curve=explode_2.Segments)  # -> Start, End
vec2pt = Vector2Pt(PointA=end.Start, PointB=end.End, Unitize=False)  # -> Vector, Length
vdis = VectorDisplay(Anchor=end.Start, Vector=vec2pt.Vector)
Z = UnitZ(Factor=series)
vec2pt_2 = Vector2Pt(PointA=end_2.Start, PointB=end_2.End, Unitize=False)  # -> Vector, Length
vdis_2 = VectorDisplay(Anchor=end_2.Start, Vector=vec2pt_2.Vector)
range = Range(Domain=Domain(0, 1), Steps=expr("x-1", number_slider_4))
crv = Curve(c_pattern_to_toolpath.toolPathsOut)
pt = Point(c_pattern_to_toolpath.PTS)
move = Move(Geometry=split.ListB, Motion=Z)  # -> Geometry, Transform
flip_3 = FlipMatrix(Data=vec2pt.Vector)
range_2 = Range(Domain=Domain(0, 1), Steps=expr("x-1", number_slider_7))
panel_4 = Panel("""; Footer Code
G1 F1500 E14.00318
M107
M104 S0
M140 S0
G92 E1
G1 E-1 F300
G162 Z F600
G162 X Y F2000
M84
M104 S0
;End of Gcode""")
flip_4 = FlipMatrix(Data=vec2pt_2.Vector)
multiplication = Multiplication(A=flip_3, B=range)
merge = Merge(Data1=split.ListA, Data2=move.Geometry)
multiplication_2 = Multiplication(A=flip_4, B=range_2)
c_gcode_compilation = CSharpScript(
    toolPaths=c_pattern_to_toolpath.toolPathsOut,
    isExtruding=c_pattern_to_toolpath.isExtrudingOut,
    feedRates=c_pattern_to_toolpath.feedRatesOut,
    header=panel_2,
    footer=panel_4,
    extrusionRate=Slider(0.05, range=0..1),
    startFR=Slider(2000, range=0..10000))  # -> out, GCodeOut; inputs toolPaths: list of Polyline, isExtruding: list of Boolean, feedRates: list of Int32, header: list of String, footer: list of String, extrusionRate: Double, startFR: Int32, save: Boolean; disabled
# ---------- c_gcode_compilation: C# ----------
    // This script takes a list of motions as Polylines,
    // data associated to it, and compiles a GCode program.

    string code = "";

    // Add header lines
    for (int i = 0; i < header.Count; i++)
    {
      string line = header[i] + "\n";  // add a new line character
      code += line;
    }

    // Keep track of how much we have extruded
    double accumulatedExtrusion = 0;

    // We need to go to the first point of the first toolpath,
    // without extruding:
    Point3d startPt = toolPaths[0][0];

    // this is just to round the input numbers to the nearest 3 digits
    double startX = Math.Round(startPt.X, 3);
    double startY = Math.Round(startPt.Y, 3);
    double startZ = Math.Round(startPt.Z, 3);

    // compose the line and add it to the program
    string startLine = "G0 F" + startFR + " X" + startX + " Y" + startY + " Z" + startZ + "\n";
    code += startLine;

    // Let's iterate over all toolpaths
    for (int j = 0; j < toolPaths.Count; j++)
    {
      // Retrieve toolpath parameters
      Polyline toolPath = toolPaths[j];
      bool extruding = isExtruding[j];
      int feedRate = feedRates[j];

      // Since the last point of the previous toolpath should coincide
      // with the beginning of the next, we skip the first point when
      // iterating over the polyline points
      for (int i = 1; i < toolPath.Count; i++)
      {
        // we can reuse the variables we declared before
        Point3d pt = toolPath[i];
        double X = Math.Round(pt.X, 3);
        double Y = Math.Round(pt.Y, 3);
        double Z = Math.Round(pt.Z, 3);

        if (extruding)
        {
          // Every point after the first we need to measure the distance and calculate how
          // much material to extrude while moving to the target point
          double dist = pt.DistanceTo(toolPath[i - 1]);
          double extrude = dist * extrusionRate;

          // always add your extrusion distance to the current extruder position
          accumulatedExtrusion += extrude;
          double e = Math.Round(accumulatedExtrusion, 5); // round position to the nearest 5 digits

          // compose the line and add it to the program
          string line = "G1 F" + feedRate + " X" + X + " Y" + Y + " Z" + Z + " E" + e + "\n";
          code += line;
        }
        else
        {
          // compose the line and add it to the program
          string line = "G0 F" + feedRate + " X" + X + " Y" + Y + " Z" + Z + "\n";
          code += line;
        }
      }
    }

    // Add footer lines
    for (int i = 0; i < footer.Count; i++)
    {
      string line = footer[i] + "\n";  // add a new line character
      code += line;
    }

    GCodeOut = code;

    //string folder = Environment.GetFolderPath(Environment.SpecialFolder.Desktop);

    //string filepath = Path.Combine(folder, filename + ".gcode");

    //if(save == true){
      //File.WriteAllText(filepath, code);
    //}
# ---------- end c_gcode_compilation ----------
c_printing_preview = CSharpScript(Crvs=crv, N=Slider(32, range=0..100))  # -> out, CrvOut; inputs Crvs: list of Curve, N: Int32
# ---------- c_printing_preview: C# ----------
    List<Curve> preview = new List<Curve>();
    for(int i = 0; i < N; i++)
    {
      preview.Add(Crvs[i]);
    }
    
    CrvOut = preview;
# ---------- end c_printing_preview ----------
move_2 = Move(Geometry=divide_2.Points, Motion=multiplication)  # -> Geometry, Transform
pline_4 = PolyLine(Vertices=flatten(merge), Closed=False)
move_3 = Move(Geometry=divide_3.Points, Motion=multiplication_2)  # -> Geometry, Transform
pline_5 = PolyLine(Vertices=flatten(move_2.Geometry), Closed=False)
number_slider_10 = Slider(0.9, range=0..10)
pline_6 = PolyLine(Vertices=flatten(move_3.Geometry), Closed=False)
panel_5 = Panel(c_gcode_compilation.GCodeOut)
vec = Vector(Vector(0, 0, 1))
number_slider_11 = Slider(0.93, range=0..10)
divlength = DivideLength(Curve=pline_5, Length=number_slider_10)  # -> Points, Tangents, Parameters
divlength_2 = DivideLength(Curve=pline_5, Length=number_slider_10)  # -> Points, Tangents, Parameters
vec_2 = Vector(Vector(0, 0, 1))
c_script_2 = CSharpScript()  # -> out, Arcs, Arcpts, pt0, Circle0; inputs points: list of Point3d, vector: Vector3d
# ---------- c_script_2: C# ----------
    
    List<Arc> arcs = new List<Arc>();

    for (int i = 0; i < (points.Count - 1); i++)
    {

      Point3d start = points[i];
      Point3d end = points[i + 1];
      Arc ac = new Arc(start, vector, end);
      arcs.Add(ac);

    }
    //Arc bc = new Arc(points[points.Count - 1], vector, points[0]);
    //arcs.Add(bc);
    //Arcs = arcs;
    List<Point3d> pts = new List<Point3d>();
    pts.Add(points[(points.Count - 1)]);
    for (int i = 0; i < (arcs.Count - 1); i++)
    {

      Point3d pt = arcs[i].MidPoint;
      pts.Add(pt);

    }
    //pts.Add(points[(points.Count - 1)]);
    // Second path of the arcs
    List<Arc> arcs_2 = new List<Arc>();

    for (int i = 0; i < (pts.Count - 1); i++)
    {

      Point3d start = pts[i];
      Point3d end = pts[i + 1];
      Arc b = new Arc(start, vector, end);
      arcs.Add(b);

    }
    Point3d point0 = new Point3d();
    point0 = pts[0];
    pt0 = point0;
    Arcpts = pts;
    Arcs = arcs;
# ---------- end c_script_2 ----------
c_script_3 = CSharpScript(points=divlength_2.Points, vector=vec_2)  # -> out, Arcs; inputs points: list of Point3d, vector: Vector3d
# ---------- c_script_3: C# ----------
    List<Arc> arcs = new List<Arc>();

    for (int i = 0; i < (points.Count - 1); i++)
    {

      Point3d start = points[i];
      Point3d end = points[i + 1];
      Arc ac = new Arc(start, vector, end);
      arcs.Add(ac);

    }
    //Arc bc = new Arc(points[points.Count - 1], vector, points[0]);
    //arcs.Add(bc);
    //Arcs = arcs;

    
    Arcs = arcs;
# ---------- end c_script_3 ----------
panel_6 = Panel("C:\Users\Benson\OneDrive - Harvard University\Introduction to Computational Design\assignment[2]\gcode")
c_script_4 = CSharpScript()  # -> out, A, B; inputs pts: list of Point3d, d: Int32
# ---------- c_script_4: C# ----------
    List<Point3d> pts_1 = new List<Point3d>();
    pts_1.Add(pts[0]);
    List<Arc> arcs = new List<Arc>();
    for (int i = 0; i < ((pts_1.Count - d) - 1); i = i + 2)
    {

      Point3d start = pts_1[i];
      Point3d middle = pts_1[i + (d + 1)];
      Point3d end = pts_1[i + 2];
      Arc ac = new Arc(start, middle, end);
      arcs.Add(ac);

    }
    //Arc bc = new Arc(points[points.Count - 1], vector, points[0]);
    //arcs.Add(bc);
    //Arcs = arcs;
    //pts.Count - d


    A = arcs;
    B = pts_1;
# ---------- end c_script_4 ----------
save = Button()
c_gcode = CSharpScript(gCode=c_gcode_compilation.GCodeOut, folder=panel_6, filename="Rwave1", save=save)  # -> out, msg; inputs startCode: String, gCode: String, endCode: String, folder: String, save: Boolean
# ---------- c_gcode: C# usings ----------
using System.IO;
# ---------- c_gcode: C# ----------
    // Concatenate your Gcode
    string gcode =
      startCode + "\n" +
      gCode +
      endCode;

    msg = gcode;

    // Create the filepath to save the gcode to
    // In this case we are saving to the desktop
    //string folder = Environment.GetFolderPath(Environment.SpecialFolder.Desktop);

    string filepath = Path.Combine(folder, filename + ".gcode");

    if(save == true){
      File.WriteAllText(filepath, gcode);
    }
# ---------- end c_gcode ----------
number_slider_12 = Slider(28, range=0..100)
crv_2 = Curve([<curve referenced from the Rhino model> x5])
panel_7 = Panel(c_gcode.msg)
divide_6 = DivideCurve(Curve=crv_2, Count=number_slider_12, Kinks=False)  # -> flatten(Points), Tangents, Parameters
c_script_5 = CSharpScript(pts=divide_6.Points, d=number_slider_12, n=Slider(5, range=0..10))  # -> out, A, B; inputs pts: list of Point3d, d: Int32, n: Int32
# ---------- c_script_5: C# ----------
    //First Path
    List<Arc> arcs = new List<Arc>();
    for (int j = 0; j < n; j++)
    {
      if (j % 2 == 0)
      {
        for (int i = 0; i < (d - 2); i = i + 2)
        {

          Point3d start = pts[i];
          Point3d middle = pts[i + (d + 1)];
          Point3d end = pts[i + 2];
          Arc ac = new Arc(start, middle, end);
          arcs.Add(ac);

        }

        Point3d start1 = pts[d - 2];
        Point3d middle1 = pts[(2 * d - 1)];
        Point3d end1 = pts[0];
        Arc ac2 = new Arc(start1, middle1, end1);
        arcs.Add(ac2);
      }
    }

    //Second Path
    List<Arc> arcs_b = new List<Arc>();

    for (int i = (n - 1) * d; i < (n * d - 2); i = i + 2)
    {

      Point3d start_b = pts[i];
      Point3d middle_b = pts[(i + 1) - d];
      Point3d end_b = pts[i + 2];
      Arc ac_b = new Arc(start_b, middle_b, end_b);
      arcs_b.Add(ac_b);

    }

    Point3d start_b1 = pts[3 * d - 2];
    Point3d middle_b1 = pts[2 * d - 1];
    Point3d end_b1 = pts[2 * d];
    Arc ac_b1 = new Arc(start_b1, middle_b1, end_b1);
    arcs_b.Add(ac_b1);
    //Arc bc = new Arc(points[points.Count - 1], vector, points[0]);
    //arcs.Add(bc);
    //Arcs = arcs;
    //pts.Count - d

    B = arcs_b;
    A = arcs;
# ---------- end c_script_5 ----------
brep_6 = Brep(<brep referenced from the Rhino model>)
number_slider_13 = Slider(43, range=0..100)
number_slider_14 = Slider(28, range=0..100)
contour_6 = Contour(Shape=brep_6, Point=Point(0, 0, 0), Direction=Vector(0, 0, 1), Distance=Slider(0.65, range=0..10))
crv_3 = Curve([<curve referenced from the Rhino model> x3])
divide_7 = DivideCurve(Curve=contour_6, Count=number_slider_13, Kinks=False)  # -> flatten(Points), Tangents, Parameters
divide_8 = DivideCurve(Curve=crv_3, Count=number_slider_14, Kinks=False)  # -> flatten(Points), Tangents, Parameters
c_script_6 = CSharpScript(pts=divide_7.Points, d=number_slider_13)  # -> out, A; inputs pts: list of Point3d, d: Int32
# ---------- c_script_6: C# ----------
    List<Arc> arcs = new List<Arc>();

    for (int i = 0; i < ((pts.Count - d) - 2); i = i + 2)
    {

      Point3d start = pts[i];
      Point3d middle = pts[i + (d + 1)];
      Point3d end = pts[i + 2];
      Arc ac = new Arc(start, middle, end);
      arcs.Add(ac);

    }

    //Point3d start1 = pts[d - 2];
    //Point3d middle1 = pts[(2 * d - 1)];
    //Point3d end1 = pts[0];
    //Arc ac2 = new Arc(start1, middle1, end1);
    //arcs.Add(ac2);
    //Arc bc = new Arc(points[points.Count - 1], vector, points[0]);
    //arcs.Add(bc);
    //Arcs = arcs;
    //pts.Count - d


    A = arcs;
# ---------- end c_script_6 ----------
c_script_7 = CSharpScript(pts=divide_8.Points, d=number_slider_14)  # -> out, A; inputs pts: list of Point3d, d: Int32; same code as c_script_6
fr2_3 = Slider(400, range=0..10000)
fr2_4 = Slider(400, range=0..10000)
panel_8 = Panel("""; Header Code for Dremel 3D45 Printer
M190 S35
M104 S220
M109 S220
G28
G1 Z50.00 F400
G92 E0
G1 F200 E3
G92 E0
M132 X Y Z A
M907 X100 Y100 Z60 A100
M107""")
c_pattern_to_toolpath_2 = CSharpScript(
    arcs=c_script_6.A,
    basePts=divide_7.Points,
    N=number_slider_13,
    x=Slider(6, range=0..10),
    FR1=Slider(100, range=0..10000),
    FR2=fr2_3,
    travelFR=fr2_4)  # -> out, toolPathsOut, isExtrudingOut, feedRatesOut, PTS; inputs arcs: list of Curve, basePts: list of Point3d, N: Int32, x: Int32, FR1: Int32, FR2: Int32, travelFR: Int32
# ---------- c_pattern_to_toolpath_2: C# ----------
    List<Polyline> toolPaths = new List<Polyline>();
    List<bool> isExtruding = new List<bool>();
    List<int> feedRates = new List<int>();

    Polyline basepl = new Polyline();
    for(int i = 0; i < N;i++)
    {
      basepl.Add(basePts[i]);
    }
    basepl.Add(basePts[0]);
    toolPaths.Add(basepl);
    isExtruding.Add(true);
    feedRates.Add(FR2);


    //subdivide curve to points
    List < Point3d > all_pts = new List<Point3d>();
    for(int i = 0; i < arcs.Count;i++)
    {
      List<double> divpara = new List<double>();
      double[] div = arcs[i].DivideByCount(x, true);

      List<Point3d> pts = new List<Point3d>();
      for(int j = 0; j < div.Length ; j++)
      {
        Point3d p = arcs[i].PointAt(div[j]);
        pts.Add(p);

      }
      //connect points to polyline and add to the toolpath
      Polyline pl = new Polyline();
      Polyline travel = new Polyline();
      for(int j = 0; j < pts.Count;j++)
      {
        pl.Add(pts[j]);
        //if(i % N == 0)
        //{

          //travel.Add(pts[j]);
          //travel.Add(pts[j] + 2 * Vector3d.ZAxis);

        //}

      }
      toolPaths.Add(pl);
      isExtruding.Add(true);
      feedRates.Add(FR1);


      //toolPaths.Add(travel);
      //isExtruding.Add(false);
      //feedRates.Add(travelFR);




    }







    toolPathsOut = toolPaths;
    isExtrudingOut = isExtruding;
    feedRatesOut = feedRates;
    PTS = all_pts;
# ---------- end c_pattern_to_toolpath_2 ----------
crv_4 = Curve(c_pattern_to_toolpath_2.toolPathsOut)
pt_2 = Point(c_pattern_to_toolpath_2.PTS)
panel_9 = Panel("""; Footer Code
G1 F1500 E14.00318
M107
M104 S0
M140 S0
G92 E1
G1 E-1 F300
G162 Z F600
G162 X Y F2000
M84
M104 S0
;End of Gcode""")
c_gcode_compilation_2 = CSharpScript(
    toolPaths=c_pattern_to_toolpath_2.toolPathsOut,
    isExtruding=c_pattern_to_toolpath_2.isExtrudingOut,
    feedRates=c_pattern_to_toolpath_2.feedRatesOut,
    header=panel_8,
    footer=panel_9,
    extrusionRate=Slider(0.05, range=0..1),
    startFR=Slider(2000, range=0..10000))  # -> out, GCodeOut; inputs toolPaths: list of Polyline, isExtruding: list of Boolean, feedRates: list of Int32, header: list of String, footer: list of String, extrusionRate: Double, startFR: Int32, save: Boolean; disabled; same code as c_gcode_compilation
c_printing_preview_2 = CSharpScript(Crvs=crv_4, N=Slider(63, range=0..100))  # -> out, CrvOut; inputs Crvs: list of Curve, N: Int32; same code as c_printing_preview
panel_10 = Panel(c_gcode_compilation_2.GCodeOut)
panel_11 = Panel("C:\Users\Benson\OneDrive - Harvard University\Introduction to Computational Design\assignment[2]\gcode")
save_2 = Button()
c_gcode_2 = CSharpScript(gCode=c_gcode_compilation_2.GCodeOut, folder=panel_11, filename="arc6", save=save_2)  # -> out, msg; inputs startCode: String, gCode: String, endCode: String, folder: String, save: Boolean; same code as c_gcode
panel_12 = Panel(c_gcode_2.msg)
