# Grasshopper definition Base.gh (Grasshopper 1.0.7)
# plug-ins: Bifocals, Pufferfish

curve = Curve(<curve referenced from the Rhino model>)

curve_2 = Curve(<curve referenced from the Rhino model>)
gap_size = Slider(0.8, range=-10..2)
crv = Curve(<curve referenced from the Rhino model>)
offset_curve = OffsetCurve(Curve=crv, Plane=PlaneXY(0, 0, 0), Distance=gap_size, BothSides=0, Kinks=0, CapType="0")
range = Range(Domain=Domain(0, 1), Steps=Slider(5, range=0..100))
tweencrv = TweenCurve(CurveA=offset_curve, CurveB=curve_2, Factor=range, BlendType=0)
flatten_tree = FlattenTree(Tree=tweencrv, Path="{0}")

gap_size_2 = Slider(0.8, range=-10..2)
crv_2 = Curve(<curve referenced from the Rhino model>)
offset_curve_2 = OffsetCurve(Curve=crv_2, Plane=PlaneXY(0, 0, 0), Distance=gap_size_2, BothSides=0, Kinks=0, CapType="0")
range_2 = Range(Domain=Domain(0, 1), Steps=Slider(5, range=0..100))
tweencrv_2 = TweenCurve(CurveA=offset_curve_2, CurveB=curve, Factor=range_2, BlendType=0)
flatten_tree_2 = FlattenTree(Tree=tweencrv_2, Path="{0}")
item = ListItem(List=flatten_tree_2, Index=Slider(2, range=0..10), Wrap=True)
item_2 = ListItem(List=flatten_tree, Index=Slider(2, range=0..10), Wrap=True)
gap_size_3 = Slider(-1.6, range=-10..2)
gap_size_4 = Slider(-1.6, range=-10..2)
curve_3 = Curve(item)
curve_4 = Curve(<curve referenced from the Rhino model>)
curve_5 = Curve(<curve referenced from the Rhino model>)
flatten_tree_3 = FlattenTree(Tree=curve_4, Path="{0}")
flatten_tree_4 = FlattenTree(Tree=curve_5, Path="{0}")
flip = FlipCurve(Curve=flatten_tree_3)  # -> Curve, Flag
merge = Merge(Data1=flip.Curve, Data2=curve_3, Data3=flatten_tree_4)  # -> graft(Result)
divide_curve = DivideCurve(Curve=merge, Count=Slider(36, range=0..100), Kinks=False)  # -> Points, Tangents, Parameters
curve_6 = Curve(<curve referenced from the Rhino model>)
curve_7 = Curve(<curve referenced from the Rhino model>)
crv_3 = Curve(<curve referenced from the Rhino model>)

curve_8 = Curve(<curve referenced from the Rhino model>)
gap_size_5 = Slider(1.2, range=-10..2)
crv_4 = Curve(<curve referenced from the Rhino model>)
offset_curve_3 = OffsetCurve(Curve=crv_4, Plane=PlaneXY(0, 0, 0), Distance=gap_size_5, BothSides=0, Kinks=0, CapType="0")
range_3 = Range(Domain=Domain(0, 1), Steps=Slider(8, range=0..100))
tweencrv_3 = TweenCurve(CurveA=offset_curve_3, CurveB=curve_8, Factor=range_3, BlendType=0)
flatten_tree_5 = FlattenTree(Tree=tweencrv_3, Path="{0}")

explode_tree = ExplodeTree(Data=divide_curve.Points)  # -> Branch0, Branch1, Branch2
curve_closest_point = CurveClosestPoint(Point=explode_tree.Branch0, Curve=curve_6)  # -> Point, Parameter, Distance
smaller_than = SmallerThan(FirstNumber=curve_closest_point.Distance, SecondNumber=Slider(0.042, range=0..10))  # -> SmallerThan, OrEqualTo
curve_closest_point_2 = CurveClosestPoint(Point=explode_tree.Branch2, Curve=curve_7)  # -> Point, Parameter, Distance
crv_5 = Curve(<curve referenced from the Rhino model>)
smaller_than_2 = SmallerThan(FirstNumber=curve_closest_point_2.Distance, SecondNumber=Slider(0.049, range=0..10))  # -> SmallerThan, OrEqualTo
cull_pattern = CullPattern(List=curve_closest_point.Point, CullPattern=smaller_than.OrEqualTo)
list_length = ListLength(List=cull_pattern)
subtraction = Subtraction(A=list_length, B="1")
cull_pattern_2 = CullPattern(List=curve_closest_point_2.Point, CullPattern=smaller_than_2.OrEqualTo)
divide_curve_2 = DivideCurve(Curve=crv_3, Count=subtraction, Kinks=False)  # -> Points, Tangents, Parameters
list_length_2 = ListLength(List=cull_pattern_2)
subtraction_2 = Subtraction(A=list_length_2, B="1")
reverse_list = ReverseList(List=divide_curve_2.Points)
divide_curve_3 = DivideCurve(Curve=crv_5, Count=subtraction_2, Kinks=False)  # -> Points, Tangents, Parameters
list_length_3 = ListLength(List=explode_tree.Branch2)
gap_size_6 = Slider(1.6, range=-10..2)
line = Line(StartPoint=cull_pattern, EndPoint=reverse_list)
reverse_list_2 = ReverseList(List=divide_curve_3.Points)
crv_6 = Curve(<curve referenced from the Rhino model>)
reverse_list_3 = ReverseList(List=explode_tree.Branch0)
list_length_4 = ListLength(List=explode_tree.Branch2)
list_length_5 = ListLength(List=line)
line_2 = Line(StartPoint=cull_pattern_2, EndPoint=reverse_list_2)
negative = Negative(Value=gap_size_6)
list_length_6 = ListLength(List=line_2)
line_3 = Line(StartPoint=explode_tree.Branch1, EndPoint=explode_tree.Branch2)
line_4 = Line(StartPoint=reverse_list_3, EndPoint=explode_tree.Branch1)
c_script = CSharpScript(x=list_length_3, y=list_length_5)  # -> out, A; inputs x: Int32, y: Int32
# ---------- c_script: C# ----------
    List<int> index = new List<int>();
    int none = x - y;
    for(int i = 0; i < none-1; i++)
    {
      index.Add(i);
    }

    A = index;
# ---------- end c_script ----------
flatten_tree_6 = FlattenTree(Tree=line, Path="{0}")
offset_curve_4 = OffsetCurve(Curve=crv_6, Plane=PlaneXY(0, 0, 0), Distance=negative, BothSides=0, Kinks=0, CapType="0")

curve_9 = Curve(<curve referenced from the Rhino model>)
range_4 = Range(Domain=Domain(0, 1), Steps=Slider(2, range=0..100))
tweencrv_4 = TweenCurve(CurveA=offset_curve_4, CurveB=curve_9, Factor=range_4, BlendType=0)
flatten_tree_7 = FlattenTree(Tree=tweencrv_4, Path="{0}")

c_script_2 = CSharpScript(x=list_length_4, y=list_length_6)  # -> out, A; inputs x: Int32, y: Int32; same code as c_script
flatten_tree_8 = FlattenTree(Tree=c_script.A, Path="{0}")
flatten_tree_9 = FlattenTree(Tree=line_2, Path="{0}")
null_placeholder = NullPlaceholder()
reverse_list_4 = ReverseList(List=flatten_tree_6)
flatten_tree_10 = FlattenTree(Tree=c_script_2.A, Path="{0}")
null_placeholder_2 = NullPlaceholder()
insert_items = InsertItems(List=null_placeholder, Indices=flatten_tree_8, Wrap=True)
entwine = Entwine(Branch00=reverse_list_4, Branch01=insert_items, FlattenInputs=True)  # -> flatten(Result)
insert_items_2 = InsertItems(List=null_placeholder_2, Indices=flatten_tree_10, Wrap=True)
entwine_2 = Entwine(Branch00=insert_items_2, Branch01=flatten_tree_9, FlattenInputs=True)  # -> flatten(Result)
entwine_3 = Entwine(Branch00=line_4, Branch01=line_3, Branch02=entwine_2, Branch03=entwine, FlattenInputs=True)
flip_matrix = FlipMatrix(Data=entwine_3)
join_curves = JoinCurves(Curves=flip_matrix, Preserve=False)  # -> flatten(Curves)
pt = Point(<point referenced from the Rhino model>)
yz_plane = YZPlane(Origin=pt)
end_points = EndPoints(Curve=join_curves)  # -> Start, End
pt_2 = Point(<point referenced from the Rhino model>)
unit_z = UnitZ(Factor=1)
yz_plane_2 = YZPlane(Origin=pt_2)
surface = Surface(<surface referenced from the Rhino model>)
divide_curve_4 = DivideCurve(Curve=flatten_tree_7, Count=Slider(50, range=0..100), Kinks=False)  # -> Points, Tangents, Parameters
c_script_3 = CSharpScript(start=end_points.Start, end=end_points.End)  # -> out, edges; inputs start: list of Point3d, end: list of Point3d
# ---------- c_script_3: C# ----------
    List<Line> Edges = new List<Line>();
    for(int i = 0; i < start.Count - 2; i++)
    {
      if(i % 2 == 0)
      {
        Line Ls = new Line(start[i + 1], start[i + 2]);
        Edges.Add(Ls);
      }

    }

    for(int i = 0; i < end.Count - 1; i++)
    {
      if(i % 2 == 0)
      {
        Line Ls = new Line(end[i], end[i + 1]);
        Edges.Add(Ls);
      }

    }


    edges = Edges;
# ---------- end c_script_3 ----------
mirror = Mirror(Geometry=flatten_tree_5, Plane=yz_plane_2)  # -> Geometry, Transform
number_slider = Slider(50, range=0..100)
pt_3 = Point(<point referenced from the Rhino model>)
join_curves_2 = JoinCurves(Curves=flatten([c_script_3.edges, join_curves]), Preserve=False)
yz_plane_3 = YZPlane(Origin=pt_3)
point = Point(<point referenced from the Rhino model>)
point_2 = Point(<point referenced from the Rhino model>)
polyline = PolyLine(Vertices=divide_curve_4.Points, Closed=False)
mirror_2 = Mirror(Geometry=polyline, Plane=yz_plane)  # -> Geometry, Transform
point_3 = Point(<point referenced from the Rhino model>)
point_4 = Point(<point referenced from the Rhino model>)
divide_curve_5 = DivideCurve(Curve=mirror.Geometry, Count=number_slider, Kinks=False)  # -> Points, Tangents, Parameters
point_5 = Point(<point referenced from the Rhino model>)
point_6 = Point(<point referenced from the Rhino model>)
divide_curve_6 = DivideCurve(Curve=flatten_tree_5, Count=number_slider, Kinks=False)  # -> Points, Tangents, Parameters
point_7 = Point(<point referenced from the Rhino model>)
point_8 = Point(<point referenced from the Rhino model>)
yz_plane_4 = YZPlane(Origin=point_7)
yz_plane_5 = YZPlane(Origin=point_8)
polyline_2 = PolyLine(Vertices=divide_curve_6.Points, Closed=False)  # -> flatten(Polyline)
move_to_point = MoveToPoint(Geometry=polyline, PointA=point, PointB=point_2)  # -> Moved, Vector, Transform
polyline_3 = PolyLine(Vertices=divide_curve_5.Points, Closed=False)  # -> flatten(Polyline)
mirror_3 = Mirror(Geometry=join_curves_2, Plane=yz_plane_5)  # -> Geometry, Transform
move_to_point_2 = MoveToPoint(Geometry=mirror_2.Geometry, PointA=point_3, PointB=point_4)  # -> Moved, Vector, Transform
join_curves_3 = JoinCurves(Curves=[mirror_2.Geometry, move_to_point.Moved], Preserve=False)
move_to_point_3 = MoveToPoint(Geometry=join_curves_3, PointA=point_5, PointB=point_6)  # -> Moved, Vector, Transform
entwine_4 = Entwine(Branch00=polyline_2, Branch01=polyline_3, FlattenInputs=True)
point_9 = Point(<point referenced from the Rhino model>)
point_10 = Point(<point referenced from the Rhino model>)
point_11 = Point(<point referenced from the Rhino model>)
end_points_2 = EndPoints(Curve=entwine_4)  # -> Start, End
point_12 = Point(<point referenced from the Rhino model>)
point_13 = Point(<point referenced from the Rhino model>)
point_14 = Point(<point referenced from the Rhino model>)
point_15 = Point(<point referenced from the Rhino model>)
point_16 = Point(<point referenced from the Rhino model>)
point_17 = Point(<point referenced from the Rhino model>)
entwine_5 = Entwine(Branch00=join_curves_2, Branch01=mirror_3.Geometry, FlattenInputs=True)  # -> flatten(Result)
c_script_4 = CSharpScript(start=end_points_2.Start, end=end_points_2.End)  # -> out, edges; inputs start: list of Point3d, end: list of Point3d; same code as c_script_3
merge_2 = Merge(Data1=point_13, Data2=point_14)  # -> graft(Result)
merge_3 = Merge(Data1=point_16, Data2=point_17)  # -> graft(Result)
entwine_6 = Entwine(
    Branch00=polyline,
    Branch01=join_curves_3,
    Branch02=move_to_point_3.Moved,
    Branch03=move_to_point_2.Moved,
    FlattenInputs=True)
point_18 = Point(<point referenced from the Rhino model>)
point_19 = Point(<point referenced from the Rhino model>)
point_20 = Point(<point referenced from the Rhino model>)
join_curves_4 = JoinCurves(Curves=flatten([entwine_4, c_script_4.edges]), Preserve=False)  # -> graft(Curves)
move_to_point_4 = MoveToPoint(Geometry=entwine_5, PointA=point_15, PointB=merge_3)  # -> flatten(Moved), Vector, Transform
move_to_point_5 = MoveToPoint(Geometry=join_curves_4, PointA=point_9, PointB=[point_10, point_11])  # -> Moved, Vector, Transform
end_points_3 = EndPoints(Curve=entwine_6)  # -> Start, End
flip_matrix_2 = FlipMatrix(Data=move_to_point_5.Moved)
entwine_7 = Entwine(Branch00=entwine_5, Branch01=move_to_point_4.Moved, FlattenInputs=True)  # -> flatten(Result)
explode_tree_2 = ExplodeTree(Data=flip_matrix_2)  # -> Branch0, Branch1
c_script_5 = CSharpScript(start=end_points_3.Start, end=end_points_3.End)  # -> out, edges; inputs start: list of Point3d, end: list of Point3d; same code as c_script_3
join_curves_5 = JoinCurves(Curves=flatten([entwine_6, c_script_5.edges]), Preserve=False)
entwine_8 = Entwine(Branch00=join_curves_4, Branch01=explode_tree_2.Branch0, Branch02=explode_tree_2.Branch1, FlattenInputs=True)
unit_z_2 = UnitZ(Factor=".2")
flatten_tree_11 = FlattenTree(Tree=join_curves_5, Path="{0}")
flatten_tree_12 = FlattenTree(Tree=entwine_8, Path="{0}")
unit_z_3 = UnitZ(Factor=".6")
move = Move(Geometry=entwine_7, Motion=unit_z_3)  # -> Geometry, Transform
# FeedRates: Can change!!!
# FR1 for non-seam
# FR2 for seam
# FR3 for travel
flatten_tree_13 = FlattenTree(Tree=move.Geometry, Path="{0}")
unit_z_4 = UnitZ(Factor=".4")
number_slider_2 = Slider(44, range=0..100)
panel = Panel("""; Header Code for Creality Ender 3 S1 Printer
M140 S60
M105
M190 S60
M104 S200
M105
M109 S200
M82 ;absolute extrusion mode

G28 ;Home

G92 E0 ;Reset Extruder
G1 Z2.0 F3000 ;Move Z Axis up
G1 X10.1 Y20 Z0.28 F5000.0 ;Move to start position
G1 X10.1 Y200.0 Z0.28 F1500.0 E15 ;Draw the first line
G1 X10.4 Y200.0 Z0.28 F5000.0 ;Move to side a little
G1 X10.4 Y20 Z0.28 F1500.0 E30 ;Draw the second line
G92 E0 ;Reset Extruder
G1 Z2.0 F3000 ;Move Z Axis up

G92 E0
G92 E0
G1 F2400 E-0.8
;LAYER_COUNT:297
;LAYER:0
M107
M204 S2000
G0 F7500 X78.848 Y89.065 Z0.2
M204 S500
;TYPE:SKIRT""")
fr2 = Slider(200, range=0..10000)
# ; Header Code for Dremel 3D45 Printer
# M190 S35
# M104 S220
# M109 S220
# G28
# G1 Z50.00 F400
# G92 E0
# G1 F200 E3
# G92 E0
# M132 X Y Z A
# M907 X100 Y100 Z60 A100
# M107
fr3 = Slider(1000, range=0..10000)
panel_2 = Panel("""; Footer Code
M140 S0
M107
G91 ;Relative positionning
G1 E-2 F2700 ;Retract a bit
G1 E-2 Z0.2 F2400 ;Retract and raise Z
G1 X5 Y5 F3000 ;Wipe out
G1 Z10 ;Raise Z more
G90 ;Absolute positionning

G1 X0 Y0 ;Present print
M106 S0 ;Turn-off fan
M104 S0 ;Turn-off hotend
M140 S0 ;Turn-off bed

M84 X Y E ;Disable all steppers but Z

M82 ;absolute extrusion mode
M104 S0
;End of Gcode""")
extrusionrate1 = Slider(0.06, range=0..1)
extrusionrate2 = Slider(0.01, range=0..1)
# ; Footer Code
# G1 F1500 E14.00318
# M107
# M104 S0
# M140 S0
# G92 E1
# G1 E-1 F300
# G162 Z F600
# G162 X Y F2000
# M84
# M104 S0
# ;End of Gcode
number_slider_3 = Slider(2000, range=0..10000)
panel_3 = Panel("C:\Users\Beichen Xie\OneDrive - Harvard University\Introduction to Computational Design\Final Project\gcode")
# FeedRates: Can change!!!
# FR1 for non-seam
# FR2 for seam
# FR3 for travel
# ExtrusionRate: Can Change!!!
# eR for non-seam print
# eR1 & eR2 for seam dash pattern
# ExtrusionRate: Can Change!!!
# eR for non-seam print
# eR1 & eR2 for seam dash pattern
save = Button()

crv_7 = Curve(<curve referenced from the Rhino model>)
crv_8 = Curve(<curve referenced from the Rhino model>)
merge_4 = Merge(Data1=crv_8)  # -> graft(Result)

offset_curve_5 = OffsetCurve(Curve=crv_7, Plane=PlaneXY(0, 0, 0), Distance=gap_size_3, BothSides=0, Kinks=0, CapType="0")

merge_5 = Merge(Data1=offset_curve_5)  # -> graft(Result)
divide_curve_7 = DivideCurve(Curve=merge_5, Count=Slider(22, range=0..100), Kinks=False)  # -> Points, Tangents, Parameters
curve_closest_point_3 = CurveClosestPoint(Point=divide_curve_7.Points, Curve=merge_4)  # -> Point, Parameter, Distance
line_5 = Line(StartPoint=curve_closest_point_3.Point, EndPoint=divide_curve_7.Points)  # -> flatten(Line)
join_curves_6 = JoinCurves(Curves=line_5, Preserve=False)
end_points_4 = EndPoints(Curve=join_curves_6)  # -> Start, End
c_script_6 = CSharpScript(start=end_points_4.Start, end=end_points_4.End)  # -> out, edges; inputs start: list of Point3d, end: list of Point3d; same code as c_script_3
join_curves_7 = JoinCurves(Curves=flatten([join_curves_6, c_script_6.edges]), Preserve=False)

curve_10 = Curve(item_2)
curve_11 = Curve(<curve referenced from the Rhino model>)
curve_12 = Curve(<curve referenced from the Rhino model>)
flatten_tree_14 = FlattenTree(Tree=curve_12, Path="{0}")
panel_4 = Panel("false")

flatten_tree_15 = FlattenTree(Tree=curve_11, Path="{0}")

flip_2 = FlipCurve(Curve=flatten_tree_15)  # -> Curve, Flag
merge_6 = Merge(Data1=flip_2.Curve, Data2=curve_10, Data3=flatten_tree_14)  # -> graft(Result)
divide_curve_8 = DivideCurve(Curve=merge_6, Count=Slider(36, range=0..100), Kinks=False)  # -> Points, Tangents, Parameters
explode_tree_3 = ExplodeTree(Data=divide_curve_8.Points)  # -> Branch0, Branch1, Branch2
reverse_list_5 = ReverseList(List=explode_tree_3.Branch0)
line_6 = Line(StartPoint=reverse_list_5, EndPoint=explode_tree_3.Branch1)
line_7 = Line(StartPoint=explode_tree_3.Branch1, EndPoint=explode_tree_3.Branch2)
entwine_9 = Entwine(Branch00=line_6, Branch01=line_7, FlattenInputs=True)
flip_matrix_3 = FlipMatrix(Data=entwine_9)
join_curves_8 = JoinCurves(Curves=flip_matrix_3, Preserve=False)  # -> flatten(Curves)
end_points_5 = EndPoints(Curve=join_curves_8)  # -> Start, End
c_script_7 = CSharpScript(start=end_points_5.Start, end=end_points_5.End)  # -> out, edges; inputs start: list of Point3d, end: list of Point3d; same code as c_script_3
join_curves_9 = JoinCurves(Curves=flatten([c_script_7.edges, join_curves_8]), Preserve=False)

crv_9 = Curve(<curve referenced from the Rhino model>)
crv_10 = Curve(<curve referenced from the Rhino model>)
merge_7 = Merge(Data1=crv_9)  # -> graft(Result)

offset_curve_6 = OffsetCurve(Curve=crv_10, Plane=PlaneXY(0, 0, 0), Distance=gap_size_4, BothSides=0, Kinks=0, CapType="0")

merge_8 = Merge(Data1=offset_curve_6)  # -> graft(Result)
divide_curve_9 = DivideCurve(Curve=merge_8, Count=Slider(14, range=0..100), Kinks=False)  # -> Points, Tangents, Parameters
length = Length(Curve=merge_8)
construct_domain = ConstructDomain(DomainStart="0", DomainEnd=length)
bounds = Bounds(Numbers=divide_curve_9.Parameters)
remap_numbers = RemapNumbers(Value=divide_curve_9.Parameters, Source=bounds, Target=construct_domain)  # -> Mapped, Clipped
curve_closest_point_4 = CurveClosestPoint(Point=divide_curve_9.Points, Curve=merge_7)  # -> Point, Parameter, Distance
evaluate_length = EvaluateLength(Curve=merge_8, Length=remap_numbers.Mapped, Normalized="false")  # -> Point, Tangent, Parameter
line_8 = Line(StartPoint=curve_closest_point_4.Point, EndPoint=divide_curve_9.Points)  # -> flatten(Line)
join_curves_10 = JoinCurves(Curves=line_8, Preserve=False)
end_points_6 = EndPoints(Curve=join_curves_10)  # -> Start, End
c_script_8 = CSharpScript(start=end_points_6.Start, end=end_points_6.End)  # -> out, edges; inputs start: list of Point3d, end: list of Point3d
# ---------- c_script_8: C# ----------
    List<Line> Edges = new List<Line>();
    for(int i = 0; i < start.Count - 2; i++)
    {
      if(i % 2 == 0)
      {
        Line Ls = new Line(start[i + 1], start[i + 2]);
        Edges.Add(Ls);
      }

    }

    for(int i = 0; i < end.Count - 2; i++)
    {
      if(i % 2 == 0)
      {
        Line Ls = new Line(end[i], end[i + 1]);
        Edges.Add(Ls);
      }

    }


    edges = Edges;
# ---------- end c_script_8 ----------
join_curves_11 = JoinCurves(Curves=flatten([join_curves_10, c_script_8.edges]), Preserve=False)

entwine_10 = Entwine(Branch00=join_curves_7, Branch01=join_curves_9, Branch02=join_curves_11, FlattenInputs=True)  # -> flatten(Result)
mirror_4 = Mirror(Geometry=entwine_10, Plane=yz_plane_4)  # -> Geometry, Transform
entwine_11 = Entwine(Branch00=entwine_10, Branch01=mirror_4.Geometry, FlattenInputs=True)  # -> flatten(Result)
move_to_point_6 = MoveToPoint(Geometry=entwine_11, PointA=point_12, PointB=merge_2)  # -> flatten(Moved), Vector, Transform
entwine_12 = Entwine(Branch00=entwine_11, Branch01=move_to_point_6.Moved, FlattenInputs=True)  # -> flatten(Result)
move_2 = Move(Geometry=entwine_12, Motion=unit_z_2)  # -> Geometry, Transform
flatten_tree_16 = FlattenTree(Tree=move_2.Geometry, Path="{0}")

curve_13 = Curve(<curve referenced from the Rhino model>)
curve_14 = Curve(<curve referenced from the Rhino model>)
range_5 = Range(Domain=Domain(0, 1), Steps=Slider(4, range=0..100))

neg = Negative(Value=Slider(1.2, range=0..2))

offset_curve_7 = OffsetCurve(Curve=curve_14, Plane=PlaneXY(0, 0, 0), Distance=neg, BothSides=0, Kinks=0, CapType="0")
tweencrv_5 = TweenCurve(CurveA=curve_13, CurveB=offset_curve_7, Factor=range_5, BlendType=0)
flatten_tree_17 = FlattenTree(Tree=tweencrv_5, Path="{0}")

project = Project(Curve=flatten_tree_17, Brep=surface, Direction=unit_z)
mirror_5 = Mirror(Geometry=project, Plane=yz_plane_3)  # -> Geometry, Transform
entwine_13 = Entwine(Branch00=project, Branch01=mirror_5.Geometry, FlattenInputs=True)
flip_matrix_4 = FlipMatrix(Data=entwine_13)
join_curves_12 = JoinCurves(Curves=flip_matrix_4, Preserve=False)
divide_curve_10 = DivideCurve(Curve=join_curves_12, Count=Slider(50, range=0..100), Kinks=False)  # -> Points, Tangents, Parameters
polyline_4 = PolyLine(Vertices=divide_curve_10.Points, Closed=False)
move_to_point_7 = MoveToPoint(Geometry=polyline_4, PointA=point_18, PointB=[point_19, point_20])  # -> Moved, Vector, Transform
flip_matrix_5 = FlipMatrix(Data=move_to_point_7.Moved)
explode_tree_4 = ExplodeTree(Data=flip_matrix_5)  # -> _0000, _0100
entwine_14 = Entwine(Branch00=polyline_4, Branch01=explode_tree_4._0000, Branch02=explode_tree_4._0100, FlattenInputs=True)
end_points_7 = EndPoints(Curve=entwine_14)  # -> Start, End
c_script_9 = CSharpScript(start=end_points_7.Start, end=end_points_7.End)  # -> out, edges; inputs start: list of Point3d, end: list of Point3d; same code as c_script_3
join_curves_13 = JoinCurves(Curves=flatten([c_script_9.edges, entwine_14]), Preserve=False)
flatten_tree_18 = FlattenTree(Tree=join_curves_13, Path="{0}")
merge_9 = Merge(Data1=flatten_tree_18, Data2=flatten_tree_12, Data3=flatten_tree_11)
move_3 = Move(Geometry=merge_9, Motion=unit_z_4)  # -> Geometry, Transform
flatten_tree_19 = FlattenTree(Tree=move_3.Geometry, Path="{0}")
merge_10 = Merge(Data1=flatten_tree_16, Data2=flatten_tree_19, Data3=flatten_tree_13)
list_item = ListItem(List=merge_10, Index=number_slider_2, Wrap=True)
panel_5 = Panel(merge_10)
c_script_10 = CSharpScript(paths=merge_10)  # -> out, travel_paths; inputs paths: list of Curve
# ---------- c_script_10: C# ----------
    List<Polyline> travels = new List<Polyline>();
    for(int i = 0; i < paths.Count - 1; i++)
    {
      Polyline travel = new Polyline();
      travel.Add(paths[i].PointAtEnd);
      travel.Add(paths[i].PointAtEnd + 2 * Vector3d.ZAxis);
      travel.Add(paths[i + 1].PointAtStart + 2 * Vector3d.ZAxis);
      travel.Add(paths[i + 1].PointAtStart);
      travels.Add(travel);
    }

    travel_paths = travels;
# ---------- end c_script_10 ----------
list_item_2 = ListItem(List=c_script_10.travel_paths, Index=number_slider_2, Wrap=True)
c_script_11 = CSharpScript(layer_1=merge_10, travel_1=c_script_10.travel_paths, FR1=Slider(400, range=0..10000), FR2=fr2, TravelFR=fr3)  # -> out, toolPathsOut, isExtrudingOut, feedRatesOut, patternOut; inputs layer_1: list of Polyline, travel_1: list of Polyline, FR1: Int32, FR2: Int32, TravelFR: Int32
# ---------- c_script_11: C# ----------
    //initialize
    List<Polyline> toolPaths = new List<Polyline>();
    List<bool> isExtruding = new List<bool>();
    List<int> feedRates = new List<int>();
    List<string> pattern = new List<string>();

    //first layer

    for(int i = 0; i < layer_1.Count;i++)
    {
      if(i == layer_1.Count - 1)
      {
        toolPaths.Add(layer_1[i]);
        isExtruding.Add(true);
        feedRates.Add(FR1);
        pattern.Add("continuous");
      }
      else
      {
        toolPaths.Add(layer_1[i]);
        isExtruding.Add(true);
        feedRates.Add(FR1);
        pattern.Add("continuous");

        toolPaths.Add(travel_1[i]);
        isExtruding.Add(false);
        feedRates.Add(TravelFR);
        pattern.Add("No Extrusion");
      }

    }







    toolPathsOut = toolPaths;
    isExtrudingOut = isExtruding;
    feedRatesOut = feedRates;
    patternOut = pattern;
# ---------- end c_script_11 ----------
c_gcode_compilation = CSharpScript(
    toolPaths=c_script_11.toolPathsOut,
    isExtruding=c_script_11.isExtrudingOut,
    feedRates=c_script_11.feedRatesOut,
    patterns=c_script_11.patternOut,
    header=panel,
    footer=panel_2,
    extrusionRate=Slider(0.05, range=0..1),
    extrusionRate1=extrusionrate1,
    extrusionRate2=extrusionrate2,
    startFR=number_slider_3)  # -> out, GCodeOut; inputs toolPaths: list of Polyline, isExtruding: list of Boolean, feedRates: list of Int32, patterns: list of String, header: list of String, footer: list of String, extrusionRate: Double, extrusionRate1: Double, extrusionRate2: Double, startFR: Int32; disabled
# ---------- c_gcode_compilation: C# ----------
    // This script takes a list of motions as Polylines,
    // data associated to it, and compiles a GCode program.

    string code = "";

    // Add header lines
    for (int i = 0; i < header.Count; i++)
    {
      string line = header[i] + "\n";  // add a new line character
      code += line;
    }

    // Keep track of how much we have extruded
    double accumulatedExtrusion = 0;

    // We need to go to the first point of the first toolpath,
    // without extruding:
    Point3d startPt = toolPaths[0][0];

    // this is just to round the input numbers to the nearest 3 digits
    double startX = Math.Round(startPt.X, 3);
    double startY = Math.Round(startPt.Y, 3);
    double startZ = Math.Round(startPt.Z, 3);

    // compose the line and add it to the program
    string startLine = "G0 F" + startFR + " X" + startX + " Y" + startY + " Z" + startZ + "\n";
    code += startLine;

    // Let's iterate over all toolpaths
    for (int j = 0; j < toolPaths.Count; j++)
    {
      // Retrieve toolpath parameters
      Polyline toolPath = toolPaths[j];
      bool extruding = isExtruding[j];
      int feedRate = feedRates[j];
      string pattern = patterns[j];


      // Since the last point of the previous toolpath should coincide
      // with the beginning of the next, we skip the first point when
      // iterating over the polyline points
      for (int i = 1; i < toolPath.Count; i++)
      {
        // we can reuse the variables we declared before
        Point3d pt = toolPath[i];
        double X = Math.Round(pt.X, 3);
        double Y = Math.Round(pt.Y, 3);
        double Z = Math.Round(pt.Z, 3);

        if (extruding && (pattern == "continuous"))
        {
          // Every point after the first we need to measure the distance and calculate how
          // much material to extrude while moving to the target point
          double dist = pt.DistanceTo(toolPath[i - 1]);
          double extrude = dist * extrusionRate;

          // always add your extrusion distance to the current extruder position
          accumulatedExtrusion += extrude;
          double e = Math.Round(accumulatedExtrusion, 5); // round position to the nearest 5 digits

          // compose the line and add it to the program
          string line = "G1 F" + feedRate + " X" + X + " Y" + Y + " Z" + Z + " E" + e + "\n";
          code += line;
        }
        else if(extruding && (pattern == "dash"))
        {
          // Every point after the first we need to measure the distance and calculate how
          // much material to extrude while moving to the target point
          double dist = pt.DistanceTo(toolPath[i - 1]);
          if(i % 2 == 0)
          {
            double extrude = dist * extrusionRate1;
            accumulatedExtrusion += extrude;
          }
          else
          {
            double extrude = dist * extrusionRate2;
            accumulatedExtrusion += extrude;
          }

          // always add your extrusion distance to the current extruder position
          //accumulatedExtrusion += extrude;
          double e = Math.Round(accumulatedExtrusion, 5); // round position to the nearest 5 digits

          // compose the line and add it to the program
          string line = "G1 F" + feedRate + " X" + X + " Y" + Y + " Z" + Z + " E" + e + "\n";
          code += line;
        }
        else
        {
          // compose the line and add it to the program
          string line = "G0 F" + feedRate + " X" + X + " Y" + Y + " Z" + Z + "\n";
          code += line;
        }
      }
    }

    // Add footer lines
    for (int i = 0; i < footer.Count; i++)
    {
      string line = footer[i] + "\n";  // add a new line character
      code += line;
    }

    GCodeOut = code;

    //string folder = Environment.GetFolderPath(Environment.SpecialFolder.Desktop);

    //string filepath = Path.Combine(folder, filename + ".gcode");

    //if(save == true){
    //File.WriteAllText(filepath, code);
    //}
# ---------- end c_gcode_compilation ----------
panel_6 = Panel(c_gcode_compilation.GCodeOut)
c_gcode = CSharpScript(gCode=c_gcode_compilation.GCodeOut, folder=panel_3, filename="Base_A", save=save)  # -> out, msg; inputs startCode: String, gCode: String, endCode: String, folder: String, save: Boolean
# ---------- c_gcode: C# usings ----------
using System.IO;
# ---------- c_gcode: C# ----------
    // Concatenate your Gcode
    string gcode =
      startCode + "\n" +
      gCode +
      endCode;

    msg = gcode;

    // Create the filepath to save the gcode to
    // In this case we are saving to the desktop
    //string folder = Environment.GetFolderPath(Environment.SpecialFolder.Desktop);

    string filepath = Path.Combine(folder, filename + ".gcode");

    if(save == true){
      File.WriteAllText(filepath, gcode);
    }
# ---------- end c_gcode ----------
panel_7 = Panel(c_gcode.msg)
