# Grasshopper definition Base_C.gh (Grasshopper 1.0.7)
# plug-ins: Bifocals, Pufferfish

print_width = Slider(51, range=0..100)
print_height = Slider(140, range=0..1000)

lower_curve_slope_x_shift = Slider(10, range=0..100)
lower_curve_slope_y_shift = Slider(48, range=0..200)
lower_curve_radius = Slider(4, range=0..10)

lower_curve_slope_x_shift_2 = Slider(6, range=0..100)
lower_curve_slope_y_shift_2 = Slider(114, range=0..200)
lower_curve_radius_2 = Slider(8, range=0..10)
lower_curve_offset = Slider(5.626, range=0..10)

lower_curve_offset_2 = Slider(5.882, range=0..10)
top_curve_offset = Slider(6.299, range=0..10)
top_curve_slope_x_shift = Slider(10, range=0..100)
top_curve_radius = Slider(4, range=0..10)
top_curve_slope_y_shift = Slider(48, range=0..200)

top_curve_offset_2 = Slider(6.299, range=0..10)
top_curve_slope_x_shift_2 = Slider(7, range=0..100)
top_curve_radius_2 = Slider(7, range=0..10)
top_curve_slope_y_shift_2 = Slider(96, range=0..200)

point = Point(<point referenced from the Rhino model>)
division = Division(A=print_width, B="2")
unit_y = UnitY(Factor=print_height)
negative = Negative(Value=division)
unit_x = UnitX(Factor=negative)
unit_x_2 = UnitX(Factor=1)
move = Move(Geometry=point, Motion=unit_y)  # -> Geometry, Transform
number = Number(top_curve_slope_y_shift_2)
number_2 = Number(top_curve_slope_x_shift_2)
number_3 = Number(top_curve_offset_2)
number_4 = Number(top_curve_radius_2)
number_5 = Number(lower_curve_slope_y_shift_2)
number_6 = Number(lower_curve_slope_x_shift_2)
number_7 = Number(lower_curve_offset)
number_8 = Number(lower_curve_radius_2)
move_2 = Move(Geometry=point, Motion=unit_x)  # -> Geometry, Transform
line_sdl = LineSDL(Start=move.Geometry, Direction=unit_x_2, Length=print_width)
line_sdl_2 = LineSDL(Start=move_2.Geometry, Direction=unit_x_2, Length=print_width)
end_points = EndPoints(Curve=line_sdl)  # -> Start, End
end_points_2 = EndPoints(Curve=line_sdl_2)  # -> Start, End
lower_curve_slope_x_shift_3 = Slider(30, range=0..100)
negative_2 = Negative(Value=number_6)
divide_curve = DivideCurve(Curve=line_sdl, Count=Slider(30, range=0..100), Kinks=False)  # -> Points, Tangents, Parameters
point_on_curve = PointOnCurve(line_sdl_2, parameter=0.5)
divide_curve_2 = DivideCurve(Curve=line_sdl_2, Count=lower_curve_slope_x_shift_3, Kinks=False)  # -> Points, Tangents, Parameters
subtraction = Subtraction(A=negative_2, B="1")
merge = Merge(Data1=number_6, Data2=subtraction)
negative_3 = Negative(Value=number_2)
unit_y_2 = UnitY(Factor=number_5)
list_item = ListItem(List=divide_curve_2.Points, Index=merge, Wrap=True)  # -> graft(Item)
point_on_curve_2 = PointOnCurve(line_sdl, parameter=0.5)
subtraction_2 = Subtraction(A=negative_3, B="1")
move_3 = Move(Geometry=point_on_curve, Motion=unit_y_2)  # -> Geometry, Transform
explode_tree = ExplodeTree(Data=list_item)  # -> Branch0, Branch1
negative_4 = Negative(Value=number)
merge_2 = Merge(Data1=number_2, Data2=subtraction_2)
panel = Panel(point_on_curve_2)
unit_y_3 = UnitY(Factor=negative_4)
list_item_2 = ListItem(List=divide_curve.Points, Index=merge_2, Wrap=True)  # -> graft(Item)
entwine = Entwine(Branch00=explode_tree.Branch0, Branch01=move_3.Geometry, Branch02=explode_tree.Branch1, FlattenInputs=True)  # -> flatten(Result)
move_4 = Move(Geometry=point_on_curve_2, Motion=unit_y_3)  # -> Geometry, Transform
explode_tree_2 = ExplodeTree(Data=list_item_2)  # -> Branch0, Branch1
polyline = PolyLine(Vertices=entwine, Closed=False)
entwine_2 = Entwine(Branch00=explode_tree_2.Branch0, Branch01=move_4.Geometry, Branch02=explode_tree_2.Branch1, FlattenInputs=True)  # -> flatten(Result)
number_slider = Slider(10, range=0..10)
polyline_2 = PolyLine(Vertices=entwine_2, Closed=False)
number_slider_2 = Slider(10, range=0..10)
fillet = Fillet(Curve=polyline, Radius=number_8)
offset_curve = OffsetCurve(Curve=fillet, Distance=number_7, Corners=1)
fillet_2 = Fillet(Curve=polyline_2, Radius=number_4)
extend_curve = ExtendCurve(Curve=offset_curve, Type=0, Start=number_slider, End=number_slider)
offset_curve_2 = OffsetCurve(Curve=fillet_2, Distance=number_3, Corners=1)
extend_curve_2 = ExtendCurve(Curve=offset_curve_2, Type=0, Start=number_slider_2, End=number_slider_2)
end_points_3 = EndPoints(Curve=extend_curve_2)  # -> Start, End
surface = Surface(<surface referenced from the Rhino model>)
unit_z = UnitZ(Factor=1)
project = Project(Curve=[extend_curve_2, extend_curve, fillet_2, fillet], Brep=surface, Direction=unit_z)  # -> graft(Curve)
explode_tree_3 = ExplodeTree(Data=project)  # -> _0000, _0001, _0010, Branch3
unit_x_3 = UnitX(Factor="0.1")
curve = Curve(explode_tree_3.Branch3)
unit_x_4 = UnitX(Factor="-0.1")
curve_2 = Curve(explode_tree_3._0000)
unit_y_4 = UnitY(Factor=1)
unit_y_5 = UnitY(Factor=1)
gap_size = Slider(0.8, range=-10..2)
range = Range(Domain=Domain(0, 1), Steps=Slider(5, range=0..100))
gap_size_2 = Slider(-1.6, range=-10..2)
gap_size_3 = Slider(1.6, range=-10..2)
number_slider_3 = Slider(10, range=0..10)
gap_size_4 = Slider(1.6, range=-10..2)
unit_z_2 = UnitZ(Factor=1)
surface_2 = Surface(<surface referenced from the Rhino model>)
surface_3 = Surface(<surface referenced from the Rhino model>)
pt = Point(<point referenced from the Rhino model>)
yz_plane = YZPlane(Origin=pt)
null_placeholder = NullPlaceholder()
pt_2 = Point(<point referenced from the Rhino model>)
unit_z_3 = UnitZ(Factor=1)
yz_plane_2 = YZPlane(Origin=pt_2)
null_placeholder_2 = NullPlaceholder()
surface_4 = Surface(<surface referenced from the Rhino model>)
number_slider_4 = Slider(50, range=0..100)
pt_3 = Point(<point referenced from the Rhino model>)
yz_plane_3 = YZPlane(Origin=pt_3)
point_2 = Point(<point referenced from the Rhino model>)
point_3 = Point(<point referenced from the Rhino model>)
point_4 = Point(<point referenced from the Rhino model>)
point_5 = Point(<point referenced from the Rhino model>)
point_6 = Point(<point referenced from the Rhino model>)
point_7 = Point(<point referenced from the Rhino model>)
point_8 = Point(<point referenced from the Rhino model>)
point_9 = Point(<point referenced from the Rhino model>)
point_10 = Point(<point referenced from the Rhino model>)
point_11 = Point(<point referenced from the Rhino model>)
yz_plane_4 = YZPlane(Origin=point_11)
point_12 = Point(<point referenced from the Rhino model>)
point_13 = Point(<point referenced from the Rhino model>)
point_14 = Point(<point referenced from the Rhino model>)
point_15 = Point(<point referenced from the Rhino model>)
point_16 = Point(<point referenced from the Rhino model>)
point_17 = Point(<point referenced from the Rhino model>)
merge_3 = Merge(Data1=point_16, Data2=point_17)  # -> graft(Result)
point_18 = Point(<point referenced from the Rhino model>)
yz_plane_5 = YZPlane(Origin=point_18)
point_19 = Point(<point referenced from the Rhino model>)
point_20 = Point(<point referenced from the Rhino model>)
point_21 = Point(<point referenced from the Rhino model>)
merge_4 = Merge(Data1=point_20, Data2=point_21)  # -> graft(Result)
unit_z_4 = UnitZ(Factor=".6")
unit_z_5 = UnitZ(Factor=".2")
unit_z_6 = UnitZ(Factor=".4")
number_slider_5 = Slider(44, range=0..100)
panel_2 = Panel("""; Header Code for Creality Ender 3 S1 Printer
M140 S60
M105
M190 S60
M104 S200
M105
M109 S200
M82 ;absolute extrusion mode

G28 ;Home

G92 E0 ;Reset Extruder
G1 Z2.0 F3000 ;Move Z Axis up
G1 X10.1 Y20 Z0.28 F5000.0 ;Move to start position
G1 X10.1 Y200.0 Z0.28 F1500.0 E15 ;Draw the first line
G1 X10.4 Y200.0 Z0.28 F5000.0 ;Move to side a little
G1 X10.4 Y20 Z0.28 F1500.0 E30 ;Draw the second line
G92 E0 ;Reset Extruder
G1 Z2.0 F3000 ;Move Z Axis up

G92 E0
G92 E0
G1 F2400 E-0.8
;LAYER_COUNT:297
;LAYER:0
M107
M204 S2000
G0 F7500 X78.848 Y89.065 Z0.2
M204 S500
;TYPE:SKIRT""")
fr2 = Slider(200, range=0..10000)
# ; Header Code for Dremel 3D45 Printer
# M190 S35
# M104 S220
# M109 S220
# G28
# G1 Z50.00 F400
# G92 E0
# G1 F200 E3
# G92 E0
# M132 X Y Z A
# M907 X100 Y100 Z60 A100
# M107
fr3 = Slider(1000, range=0..10000)
panel_3 = Panel("""; Footer Code
M140 S0
M107
G91 ;Relative positionning
G1 E-2 F2700 ;Retract a bit
G1 E-2 Z0.2 F2400 ;Retract and raise Z
G1 X5 Y5 F3000 ;Wipe out
G1 Z10 ;Raise Z more
G90 ;Absolute positionning

G1 X0 Y0 ;Present print
M106 S0 ;Turn-off fan
M104 S0 ;Turn-off hotend
M140 S0 ;Turn-off bed

M84 X Y E ;Disable all steppers but Z

M82 ;absolute extrusion mode
M104 S0
;End of Gcode""")
extrusionrate1 = Slider(0.06, range=0..1)
extrusionrate2 = Slider(0.01, range=0..1)
# ; Footer Code
# G1 F1500 E14.00318
# M107
# M104 S0
# M140 S0
# G92 E1
# G1 E-1 F300
# G162 Z F600
# G162 X Y F2000
# M84
# M104 S0
# ;End of Gcode
number_slider_6 = Slider(2000, range=0..10000)
panel_4 = Panel("C:\Users\Beichen Xie\OneDrive - Harvard University\Introduction to Computational Design\Final Project\production files\gcode")
# FeedRates: Can change!!!
# FR1 for non-seam
# FR2 for seam
# FR3 for travel
# ExtrusionRate: Can Change!!!
# eR for non-seam print
# eR1 & eR2 for seam dash pattern
save = Button()

end_points_4 = EndPoints(Curve=explode_tree_3._0010)  # -> Start, End
explode = Explode(Curve=explode_tree_3._0010, Recursive=True)  # -> Segments, Vertices
unit_y_6 = UnitY(Factor="1")
move_5 = Move(Geometry=end_points_4.Start, Motion=unit_y_6)  # -> Geometry, Transform
list_item_3 = ListItem(List=explode.Segments, Index="0", Wrap=True)
list_item_4 = ListItem(List=explode.Vertices, Index="1", Wrap=True)
point_on_curve_3 = PointOnCurve(list_item_3, parameter=0.5)
cull_index = CullIndex(List=explode.Segments, Indices="0", Wrap=True)

move_6 = Move(Geometry=move_5.Geometry, Motion=unit_x_3)  # -> Geometry, Transform

entwine_3 = Entwine(Branch00=list_item_4, Branch01=point_on_curve_3, Branch02=move_6.Geometry, FlattenInputs=True)  # -> flatten(Result)
interpolate = Interpolate(Vertices=entwine_3, Degree=3, Periodic=False, KnotStyle=1)  # -> Curve, Length, Domain
entwine_4 = Entwine(Branch00=cull_index, Branch01=interpolate.Curve, FlattenInputs=True)  # -> flatten(Result)
join_curves = JoinCurves(Curves=entwine_4, Preserve=False)

curve_3 = Curve(join_curves)
end_points_5 = EndPoints(Curve=curve_3)  # -> Start, End
distance = Distance(PointA=end_points_5.Start, PointB=end_points.Start)
point_22 = Point(end_points_5.Start)
line_sdl_3 = LineSDL(Start=point_22, Direction=unit_y_5, Length=distance)
join_curves_2 = JoinCurves(Curves=[curve_3, line_sdl_3], Preserve=False)

end_points_6 = EndPoints(Curve=explode_tree_3._0001)  # -> Start, End
unit_y_7 = UnitY(Factor="-1")
explode_2 = Explode(Curve=explode_tree_3._0001, Recursive=True)  # -> Segments, Vertices
move_7 = Move(Geometry=end_points_6.End, Motion=unit_y_7)  # -> Geometry, Transform
list_item_5 = ListItem(List=explode_2.Segments, Index="2", Wrap=True)
list_item_6 = ListItem(List=explode_2.Vertices, Index="2", Wrap=True)
cull_index_2 = CullIndex(List=explode_2.Segments, Indices="2", Wrap=True)
point_on_curve_4 = PointOnCurve(list_item_5, parameter=0.5)

move_8 = Move(Geometry=move_7.Geometry, Motion=unit_x_4)  # -> Geometry, Transform

entwine_5 = Entwine(Branch00=list_item_6, Branch01=point_on_curve_4, Branch02=move_8.Geometry, FlattenInputs=True)  # -> flatten(Result)
interpolate_2 = Interpolate(Vertices=entwine_5, Degree=3, Periodic=False, KnotStyle=1)  # -> Curve, Length, Domain
entwine_6 = Entwine(Branch00=cull_index_2, Branch01=interpolate_2.Curve, FlattenInputs=True)  # -> flatten(Result)
join_curves_3 = JoinCurves(Curves=entwine_6, Preserve=False)

curve_4 = Curve(join_curves_3)
end_points_7 = EndPoints(Curve=curve_4)  # -> Start, End
distance_2 = Distance(PointA=end_points_7.End, PointB=end_points_2.End)
point_23 = Point(end_points_7.End)
negative_5 = Negative(Value=distance_2)
line_sdl_4 = LineSDL(Start=point_23, Direction=unit_y_4, Length=negative_5)
join_curves_4 = JoinCurves(Curves=[curve_4, line_sdl_4], Preserve=False)
entwine_7 = Entwine(
    Branch00=curve_2,
    Branch01=curve_4,
    Branch02=curve_3,
    Branch03=curve,
    Branch04=join_curves_4,
    Branch05=join_curves_2,
    FlattenInputs=True)
explode_tree_4 = ExplodeTree(Data=entwine_7)  # -> Branch0, Branch1, Branch2, Branch3, Branch4, Branch5
curve_5 = Curve(explode_tree_4.Branch2)
curve_6 = Curve(explode_tree_4.Branch4)
crv = Curve(curve_6)
offset_curve_3 = OffsetCurve(Curve=crv, Plane=PlaneXY(0, 0, 0), Distance=gap_size, BothSides=0, Kinks=0, CapType="0")
curve_7 = Curve(explode_tree_4.Branch3)
curve_8 = Curve(explode_tree_4.Branch5)
curve_9 = Curve(curve_8)

curve_10 = Curve(curve_8)
gap_size_5 = Slider(0.8, range=-10..2)
crv_2 = Curve(curve_6)
offset_curve_4 = OffsetCurve(Curve=crv_2, Plane=PlaneXY(0, 0, 0), Distance=gap_size_5, BothSides=0, Kinks=0, CapType="0")
range_2 = Range(Domain=Domain(0, 1), Steps=Slider(5, range=0..100))
tweencrv = TweenCurve(CurveA=offset_curve_4, CurveB=curve_10, Factor=range_2, BlendType=0)
flatten_tree = FlattenTree(Tree=tweencrv, Path="{0}")

tweencrv_2 = TweenCurve(CurveA=offset_curve_3, CurveB=curve_9, Factor=range, BlendType=0)
simplify_curve = SimplifyCurve(Curve=curve_8)  # -> Curve, Simplified
flatten_tree_2 = FlattenTree(Tree=tweencrv_2, Path="{0}")
curve_11 = Curve(explode_tree_4.Branch0)
curve_12 = Curve(explode_tree_4.Branch1)
item = ListItem(List=flatten_tree_2, Index=Slider(2, range=0..10), Wrap=True)
simplify_curve_2 = SimplifyCurve(Curve=curve_6)  # -> Curve, Simplified
rebuild_curve = RebuildCurve(Curve=simplify_curve_2.Curve, Count=Slider(100, range=0..100), Degree=Slider(3, range=0..10), EndTangents=True)
rebuild_curve_2 = RebuildCurve(Curve=simplify_curve.Curve, Count=Slider(100, range=0..100), Degree=Slider(3, range=0..10), EndTangents=False)
curve_13 = Curve(item)
curve_14 = Curve(curve_6)
curve_15 = Curve(curve_8)
flatten_tree_3 = FlattenTree(Tree=curve_14, Path="{0}")
flatten_tree_4 = FlattenTree(Tree=curve_15, Path="{0}")
flip = FlipCurve(Curve=flatten_tree_3)  # -> Curve, Flag
merge_5 = Merge(Data1=flip.Curve, Data2=curve_13, Data3=flatten_tree_4)  # -> graft(Result)
crv_3 = Curve(curve_11)
curve_16 = Curve(curve_12)
item_2 = ListItem(List=flatten_tree, Index=Slider(2, range=0..10), Wrap=True)

curve_17 = Curve(rebuild_curve_2)
gap_size_6 = Slider(1.2, range=-10..2)
crv_4 = Curve(rebuild_curve)
offset_curve_5 = OffsetCurve(Curve=crv_4, Plane=PlaneXY(0, 0, 0), Distance=gap_size_6, BothSides=0, Kinks=0, CapType="0")
range_3 = Range(Domain=Domain(0, 1), Steps=Slider(8, range=0..100))
tweencrv_3 = TweenCurve(CurveA=offset_curve_5, CurveB=curve_17, Factor=range_3, BlendType=0)
flatten_tree_5 = FlattenTree(Tree=tweencrv_3, Path="{0}")

divide_curve_3 = DivideCurve(Curve=merge_5, Count=Slider(36, range=0..100), Kinks=False)  # -> Points, Tangents, Parameters
crv_5 = Curve(curve_7)
curve_18 = Curve(curve_5)
explode_tree_5 = ExplodeTree(Data=divide_curve_3.Points)  # -> Branch0, Branch1, Branch2
curve_closest_point = CurveClosestPoint(Point=explode_tree_5.Branch0, Curve=curve_16)  # -> Point, Parameter, Distance
smaller_than = SmallerThan(FirstNumber=curve_closest_point.Distance, SecondNumber=Slider(0.042, range=0..10))  # -> SmallerThan, OrEqualTo
curve_closest_point_2 = CurveClosestPoint(Point=explode_tree_5.Branch2, Curve=curve_18)  # -> Point, Parameter, Distance
crv_6 = Curve(curve_5)
smaller_than_2 = SmallerThan(FirstNumber=curve_closest_point_2.Distance, SecondNumber=Slider(0.049, range=0..10))  # -> SmallerThan, OrEqualTo
cull_pattern = CullPattern(List=curve_closest_point.Point, CullPattern=smaller_than.OrEqualTo)
list_length = ListLength(List=cull_pattern)
subtraction_3 = Subtraction(A=list_length, B="1")
cull_pattern_2 = CullPattern(List=curve_closest_point_2.Point, CullPattern=smaller_than_2.OrEqualTo)
divide_curve_4 = DivideCurve(Curve=crv_3, Count=subtraction_3, Kinks=False)  # -> Points, Tangents, Parameters
list_length_2 = ListLength(List=cull_pattern_2)
subtraction_4 = Subtraction(A=list_length_2, B="1")
offset_curve_6 = OffsetCurve(Curve=crv_6, Plane=PlaneXY(0, 0, 0), Distance=gap_size_4, BothSides=0, Kinks=0, CapType="0")
divide_curve_5 = DivideCurve(Curve=crv_5, Count=subtraction_4, Kinks=False)  # -> Points, Tangents, Parameters
reverse_list = ReverseList(List=divide_curve_4.Points)
list_length_3 = ListLength(List=explode_tree_5.Branch2)
line = Line(StartPoint=cull_pattern, EndPoint=reverse_list)
reverse_list_2 = ReverseList(List=divide_curve_5.Points)
reverse_list_3 = ReverseList(List=explode_tree_5.Branch0)
list_length_4 = ListLength(List=explode_tree_5.Branch2)
list_length_5 = ListLength(List=line)
line_2 = Line(StartPoint=cull_pattern_2, EndPoint=divide_curve_5.Points)
line_3 = Line(StartPoint=explode_tree_5.Branch1, EndPoint=explode_tree_5.Branch2)
list_length_6 = ListLength(List=line_2)
line_4 = Line(StartPoint=reverse_list_3, EndPoint=explode_tree_5.Branch1)
c_script = CSharpScript(x=list_length_3, y=list_length_5)  # -> out, A; inputs x: Int32, y: Int32
# ---------- c_script: C# ----------
    List<int> index = new List<int>();
    int none = x - y;
    for(int i = 0; i < none-1; i++)
    {
      index.Add(i);
    }

    A = index;
# ---------- end c_script ----------
flatten_tree_6 = FlattenTree(Tree=line, Path="{0}")
c_script_2 = CSharpScript(x=list_length_4, y=list_length_6)  # -> out, A; inputs x: Int32, y: Int32; same code as c_script
flatten_tree_7 = FlattenTree(Tree=c_script.A, Path="{0}")
flatten_tree_8 = FlattenTree(Tree=line_2, Path="{0}")
reverse_list_4 = ReverseList(List=flatten_tree_6)
flatten_tree_9 = FlattenTree(Tree=c_script_2.A, Path="{0}")
insert_items = InsertItems(List=null_placeholder, Indices=flatten_tree_7, Wrap=True)
entwine_8 = Entwine(Branch00=reverse_list_4, Branch01=insert_items, FlattenInputs=True)  # -> flatten(Result)
mirror = Mirror(Geometry=flatten_tree_5, Plane=yz_plane_2)  # -> Geometry, Transform
insert_items_2 = InsertItems(List=null_placeholder_2, Indices=flatten_tree_9, Wrap=True)
entwine_9 = Entwine(Branch00=insert_items_2, Branch01=flatten_tree_8, FlattenInputs=True)  # -> flatten(Result)
entwine_10 = Entwine(Branch00=line_4, Branch01=line_3, Branch02=entwine_9, Branch03=entwine_8, FlattenInputs=True)
flip_matrix = FlipMatrix(Data=entwine_10)
join_curves_5 = JoinCurves(Curves=flip_matrix, Preserve=False)  # -> flatten(Curves)
divide_curve_6 = DivideCurve(Curve=mirror.Geometry, Count=number_slider_4, Kinks=False)  # -> Points, Tangents, Parameters
divide_curve_7 = DivideCurve(Curve=flatten_tree_5, Count=number_slider_4, Kinks=False)  # -> Points, Tangents, Parameters
end_points_8 = EndPoints(Curve=join_curves_5)  # -> Start, End
c_script_3 = CSharpScript(start=end_points_8.Start, end=end_points_8.End)  # -> out, edges; inputs start: list of Point3d, end: list of Point3d
# ---------- c_script_3: C# ----------
    List<Line> Edges = new List<Line>();
    for(int i = 0; i < start.Count - 2; i++)
    {
      if(i % 2 == 0)
      {
        Line Ls = new Line(start[i + 1], start[i + 2]);
        Edges.Add(Ls);
      }

    }

    for(int i = 0; i < end.Count - 1; i++)
    {
      if(i % 2 == 0)
      {
        Line Ls = new Line(end[i], end[i + 1]);
        Edges.Add(Ls);
      }

    }


    edges = Edges;
# ---------- end c_script_3 ----------
polyline_3 = PolyLine(Vertices=divide_curve_7.Points, Closed=False)  # -> flatten(Polyline)
polyline_4 = PolyLine(Vertices=divide_curve_6.Points, Closed=False)  # -> flatten(Polyline)
join_curves_6 = JoinCurves(Curves=flatten([c_script_3.edges, join_curves_5]), Preserve=False)
entwine_11 = Entwine(Branch00=polyline_3, Branch01=polyline_4, FlattenInputs=True)
end_points_9 = EndPoints(Curve=entwine_11)  # -> Start, End
c_script_4 = CSharpScript(start=end_points_9.Start, end=end_points_9.End)  # -> out, edges; inputs start: list of Point3d, end: list of Point3d; same code as c_script_3
mirror_2 = Mirror(Geometry=join_curves_6, Plane=yz_plane_4)  # -> Geometry, Transform
join_curves_7 = JoinCurves(Curves=flatten([entwine_11, c_script_4.edges]), Preserve=False)  # -> graft(Curves)
move_to_point = MoveToPoint(Geometry=join_curves_7, PointA=point_8, PointB=[point_9, point_10])  # -> Moved, Vector, Transform
flip_matrix_2 = FlipMatrix(Data=move_to_point.Moved)
explode_tree_6 = ExplodeTree(Data=flip_matrix_2)  # -> Branch0, Branch1
entwine_12 = Entwine(Branch00=join_curves_6, Branch01=mirror_2.Geometry, FlattenInputs=True)  # -> flatten(Result)
entwine_13 = Entwine(Branch00=join_curves_7, Branch01=explode_tree_6.Branch0, Branch02=explode_tree_6.Branch1, FlattenInputs=True)
move_to_point_2 = MoveToPoint(Geometry=entwine_12, PointA=point_15, PointB=merge_3)  # -> flatten(Moved), Vector, Transform
entwine_14 = Entwine(Branch00=entwine_12, Branch01=move_to_point_2.Moved, FlattenInputs=True)  # -> flatten(Result)
flatten_tree_10 = FlattenTree(Tree=entwine_13, Path="{0}")
move_9 = Move(Geometry=entwine_14, Motion=unit_z_4)  # -> Geometry, Transform
# ExtrusionRate: Can Change!!!
# eR for non-seam print
# eR1 & eR2 for seam dash pattern
# FeedRates: Can change!!!
# FR1 for non-seam
# FR2 for seam
# FR3 for travel
flatten_tree_11 = FlattenTree(Tree=move_9.Geometry, Path="{0}")

curve_19 = Curve(curve_11)
curve_20 = Curve(curve_12)
range_4 = Range(Domain=Domain(0, 1), Steps=Slider(4, range=0..100))

neg = Negative(Value=Slider(1.2, range=0..2))

curve_21 = Curve(curve_7)
range_5 = Range(Domain=Domain(0, 1), Steps=Slider(3, range=0..100))
tweencrv_4 = TweenCurve(CurveA=offset_curve_6, CurveB=curve_21, Factor=range_5, BlendType=0)

project_2 = Project(Curve=tweencrv_4, Brep=surface_3, Direction=Vector(0, 0, 1))

flatten_tree_12 = FlattenTree(Tree=project_2, Path="{0}")

divide_curve_8 = DivideCurve(Curve=flatten_tree_12, Count=Slider(50, range=0..100), Kinks=False)  # -> Points, Tangents, Parameters
polyline_5 = PolyLine(Vertices=divide_curve_8.Points, Closed=False)
mirror_3 = Mirror(Geometry=polyline_5, Plane=yz_plane)  # -> Geometry, Transform
move_to_point_3 = MoveToPoint(Geometry=polyline_5, PointA=point_2, PointB=point_3)  # -> Moved, Vector, Transform
move_to_point_4 = MoveToPoint(Geometry=mirror_3.Geometry, PointA=point_4, PointB=point_5)  # -> Moved, Vector, Transform
join_curves_8 = JoinCurves(Curves=[mirror_3.Geometry, move_to_point_3.Moved], Preserve=False)
move_to_point_5 = MoveToPoint(Geometry=join_curves_8, PointA=point_6, PointB=point_7)  # -> Moved, Vector, Transform
entwine_15 = Entwine(
    Branch00=polyline_5,
    Branch01=join_curves_8,
    Branch02=move_to_point_5.Moved,
    Branch03=move_to_point_4.Moved,
    FlattenInputs=True)
end_points_10 = EndPoints(Curve=entwine_15)  # -> Start, End
c_script_5 = CSharpScript(start=end_points_10.Start, end=end_points_10.End)  # -> out, edges; inputs start: list of Point3d, end: list of Point3d; same code as c_script_3
join_curves_9 = JoinCurves(Curves=flatten([entwine_15, c_script_5.edges]), Preserve=False)
flatten_tree_13 = FlattenTree(Tree=join_curves_9, Path="{0}")

crv_7 = Curve(curve_12)
crv_8 = Curve(curve_11)
merge_6 = Merge(Data1=crv_8)  # -> graft(Result)

offset_curve_7 = OffsetCurve(Curve=crv_7, Plane=PlaneXY(0, 0, 0), Distance=gap_size_2, BothSides=0, Kinks=0, CapType="0")

merge_7 = Merge(Data1=offset_curve_7)  # -> graft(Result)
divide_curve_9 = DivideCurve(Curve=merge_7, Count=Slider(22, range=0..100), Kinks=False)  # -> Points, Tangents, Parameters
curve_closest_point_3 = CurveClosestPoint(Point=divide_curve_9.Points, Curve=merge_6)  # -> Point, Parameter, Distance
line_5 = Line(StartPoint=curve_closest_point_3.Point, EndPoint=divide_curve_9.Points)  # -> flatten(Line)
join_curves_10 = JoinCurves(Curves=line_5, Preserve=False)
end_points_11 = EndPoints(Curve=join_curves_10)  # -> Start, End
c_script_6 = CSharpScript(start=end_points_11.Start, end=end_points_11.End)  # -> out, edges; inputs start: list of Point3d, end: list of Point3d; same code as c_script_3
join_curves_11 = JoinCurves(Curves=flatten([join_curves_10, c_script_6.edges]), Preserve=False)

curve_22 = Curve(item_2)
curve_23 = Curve(curve_6)
curve_24 = Curve(curve_8)
flatten_tree_14 = FlattenTree(Tree=curve_24, Path="{0}")
panel_5 = Panel("false")

flatten_tree_15 = FlattenTree(Tree=curve_23, Path="{0}")

flip_2 = FlipCurve(Curve=flatten_tree_15)  # -> Curve, Flag
merge_8 = Merge(Data1=flip_2.Curve, Data2=curve_22, Data3=flatten_tree_14)  # -> graft(Result)
divide_curve_10 = DivideCurve(Curve=merge_8, Count=Slider(36, range=0..100), Kinks=False)  # -> Points, Tangents, Parameters
explode_tree_7 = ExplodeTree(Data=divide_curve_10.Points)  # -> Branch0, Branch1, Branch2
reverse_list_5 = ReverseList(List=explode_tree_7.Branch0)
line_6 = Line(StartPoint=reverse_list_5, EndPoint=explode_tree_7.Branch1)
line_7 = Line(StartPoint=explode_tree_7.Branch1, EndPoint=explode_tree_7.Branch2)
entwine_16 = Entwine(Branch00=line_6, Branch01=line_7, FlattenInputs=True)
flip_matrix_3 = FlipMatrix(Data=entwine_16)
join_curves_12 = JoinCurves(Curves=flip_matrix_3, Preserve=False)  # -> flatten(Curves)
end_points_12 = EndPoints(Curve=join_curves_12)  # -> Start, End
c_script_7 = CSharpScript(start=end_points_12.Start, end=end_points_12.End)  # -> out, edges; inputs start: list of Point3d, end: list of Point3d; same code as c_script_3
join_curves_13 = JoinCurves(Curves=flatten([c_script_7.edges, join_curves_12]), Preserve=False)

crv_9 = Curve(curve_5)
crv_10 = Curve(curve_7)
merge_9 = Merge(Data1=crv_10)  # -> graft(Result)
divide_curve_11 = DivideCurve(Curve=merge_9, Count=Slider(14, range=0..100), Kinks=False)  # -> Points, Tangents, Parameters
length = Length(Curve=merge_9)
construct_domain = ConstructDomain(DomainStart="0", DomainEnd=length)
bounds = Bounds(Numbers=divide_curve_11.Parameters)
remap_numbers = RemapNumbers(Value=divide_curve_11.Parameters, Source=bounds, Target=construct_domain)  # -> Mapped, Clipped
evaluate_length = EvaluateLength(Curve=merge_9, Length=remap_numbers.Mapped, Normalized="false")  # -> Point, Tangent, Parameter

offset_curve_8 = OffsetCurve(Curve=crv_9, Plane=PlaneXY(0, 0, 0), Distance=gap_size_3, BothSides=0, Kinks=0, CapType="0")

merge_10 = Merge(Data1=offset_curve_8)  # -> graft(Result)
curve_closest_point_4 = CurveClosestPoint(Point=divide_curve_11.Points, Curve=merge_10)  # -> Point, Parameter, Distance
line_8 = Line(StartPoint=curve_closest_point_4.Point, EndPoint=divide_curve_11.Points)  # -> flatten(Line)
join_curves_14 = JoinCurves(Curves=line_8, Preserve=False)
end_points_13 = EndPoints(Curve=join_curves_14)  # -> Start, End
c_script_8 = CSharpScript(start=end_points_13.Start, end=end_points_13.End)  # -> out, edges; inputs start: list of Point3d, end: list of Point3d
# ---------- c_script_8: C# ----------
    List<Line> Edges = new List<Line>();
    for(int i = 0; i < start.Count - 2; i++)
    {
      if(i % 2 == 0)
      {
        Line Ls = new Line(start[i + 1], start[i + 2]);
        Edges.Add(Ls);
      }

    }

    for(int i = 0; i < end.Count - 2; i++)
    {
      if(i % 2 == 0)
      {
        Line Ls = new Line(end[i], end[i + 1]);
        Edges.Add(Ls);
      }

    }


    edges = Edges;
# ---------- end c_script_8 ----------
join_curves_15 = JoinCurves(Curves=flatten([join_curves_14, c_script_8.edges]), Preserve=False)

entwine_17 = Entwine(Branch00=join_curves_11, Branch01=join_curves_13, Branch02=join_curves_15, FlattenInputs=True)  # -> flatten(Result)
mirror_4 = Mirror(Geometry=entwine_17, Plane=yz_plane_5)  # -> Geometry, Transform
entwine_18 = Entwine(Branch00=entwine_17, Branch01=mirror_4.Geometry, FlattenInputs=True)  # -> flatten(Result)
move_to_point_6 = MoveToPoint(Geometry=entwine_18, PointA=point_19, PointB=merge_4)  # -> flatten(Moved), Vector, Transform
entwine_19 = Entwine(Branch00=entwine_18, Branch01=move_to_point_6.Moved, FlattenInputs=True)  # -> flatten(Result)
move_10 = Move(Geometry=entwine_19, Motion=unit_z_5)  # -> Geometry, Transform
flatten_tree_16 = FlattenTree(Tree=move_10.Geometry, Path="{0}")

offset_curve_9 = OffsetCurve(Curve=curve_20, Plane=PlaneXY(0, 0, 0), Distance=neg, BothSides=0, Kinks=0, CapType="0")

extend_curve_3 = ExtendCurve(Curve=offset_curve_9, Type=0, Start=number_slider_3, End=number_slider_3)
project_3 = Project(Curve=extend_curve_3, Brep=surface_2, Direction=unit_z_2)

tweencrv_5 = TweenCurve(CurveA=curve_19, CurveB=project_3, Factor=range_4, BlendType=0)
flatten_tree_17 = FlattenTree(Tree=tweencrv_5, Path="{0}")

project_4 = Project(Curve=flatten_tree_17, Brep=surface_4, Direction=unit_z_3)
mirror_5 = Mirror(Geometry=project_4, Plane=yz_plane_3)  # -> Geometry, Transform
entwine_20 = Entwine(Branch00=project_4, Branch01=mirror_5.Geometry, FlattenInputs=True)
flip_matrix_4 = FlipMatrix(Data=entwine_20)
join_curves_16 = JoinCurves(Curves=flip_matrix_4, Preserve=False)
divide_curve_12 = DivideCurve(Curve=join_curves_16, Count=Slider(50, range=0..100), Kinks=False)  # -> Points, Tangents, Parameters
panel_6 = Panel(join_curves_16)
polyline_6 = PolyLine(Vertices=divide_curve_12.Points, Closed=False)
move_to_point_7 = MoveToPoint(Geometry=polyline_6, PointA=point_12, PointB=[point_13, point_14])  # -> Moved, Vector, Transform
flip_matrix_5 = FlipMatrix(Data=move_to_point_7.Moved)
explode_tree_8 = ExplodeTree(Data=flip_matrix_5)  # -> _0000, _0100
entwine_21 = Entwine(Branch00=polyline_6, Branch01=explode_tree_8._0000, Branch02=explode_tree_8._0100, FlattenInputs=True)
end_points_14 = EndPoints(Curve=entwine_21)  # -> Start, End
c_script_9 = CSharpScript(start=end_points_14.Start, end=end_points_14.End)  # -> out, edges; inputs start: list of Point3d, end: list of Point3d; same code as c_script_3
join_curves_17 = JoinCurves(Curves=flatten([c_script_9.edges, entwine_21]), Preserve=False)
flatten_tree_18 = FlattenTree(Tree=join_curves_17, Path="{0}")
merge_11 = Merge(Data1=flatten_tree_18, Data2=flatten_tree_10, Data3=flatten_tree_13)
move_11 = Move(Geometry=merge_11, Motion=unit_z_6)  # -> Geometry, Transform
flatten_tree_19 = FlattenTree(Tree=move_11.Geometry, Path="{0}")
merge_12 = Merge(Data1=flatten_tree_11, Data2=flatten_tree_19, Data3=flatten_tree_16)
list_item_7 = ListItem(List=merge_12, Index=number_slider_5, Wrap=True)
panel_7 = Panel(merge_12)
c_script_10 = CSharpScript(paths=merge_12)  # -> out, travel_paths; inputs paths: list of Curve
# ---------- c_script_10: C# ----------
    List<Polyline> travels = new List<Polyline>();
    for(int i = 0; i < paths.Count - 1; i++)
    {
      Polyline travel = new Polyline();
      travel.Add(paths[i].PointAtEnd);
      travel.Add(paths[i].PointAtEnd + 2 * Vector3d.ZAxis);
      travel.Add(paths[i + 1].PointAtStart + 2 * Vector3d.ZAxis);
      travel.Add(paths[i + 1].PointAtStart);
      travels.Add(travel);
    }

    travel_paths = travels;
# ---------- end c_script_10 ----------
list_item_8 = ListItem(List=c_script_10.travel_paths, Index=number_slider_5, Wrap=True)
c_script_11 = CSharpScript(layer_1=merge_12, travel_1=c_script_10.travel_paths, FR1=Slider(400, range=0..10000), FR2=fr2, TravelFR=fr3)  # -> out, toolPathsOut, isExtrudingOut, feedRatesOut, patternOut; inputs layer_1: list of Polyline, travel_1: list of Polyline, FR1: Int32, FR2: Int32, TravelFR: Int32
# ---------- c_script_11: C# ----------
    //initialize
    List<Polyline> toolPaths = new List<Polyline>();
    List<bool> isExtruding = new List<bool>();
    List<int> feedRates = new List<int>();
    List<string> pattern = new List<string>();

    //first layer

    for(int i = 0; i < layer_1.Count;i++)
    {
      if(i == layer_1.Count - 1)
      {
        toolPaths.Add(layer_1[i]);
        isExtruding.Add(true);
        feedRates.Add(FR1);
        pattern.Add("continuous");
      }
      else
      {
        toolPaths.Add(layer_1[i]);
        isExtruding.Add(true);
        feedRates.Add(FR1);
        pattern.Add("continuous");

        toolPaths.Add(travel_1[i]);
        isExtruding.Add(false);
        feedRates.Add(TravelFR);
        pattern.Add("No Extrusion");
      }

    }







    toolPathsOut = toolPaths;
    isExtrudingOut = isExtruding;
    feedRatesOut = feedRates;
    patternOut = pattern;
# ---------- end c_script_11 ----------
c_gcode_compilation = CSharpScript(
    toolPaths=c_script_11.toolPathsOut,
    isExtruding=c_script_11.isExtrudingOut,
    feedRates=c_script_11.feedRatesOut,
    patterns=c_script_11.patternOut,
    header=panel_2,
    footer=panel_3,
    extrusionRate=Slider(0.05, range=0..1),
    extrusionRate1=extrusionrate1,
    extrusionRate2=extrusionrate2,
    startFR=number_slider_6)  # -> out, GCodeOut; inputs toolPaths: list of Polyline, isExtruding: list of Boolean, feedRates: list of Int32, patterns: list of String, header: list of String, footer: list of String, extrusionRate: Double, extrusionRate1: Double, extrusionRate2: Double, startFR: Int32; disabled
# ---------- c_gcode_compilation: C# ----------
    // This script takes a list of motions as Polylines,
    // data associated to it, and compiles a GCode program.

    string code = "";

    // Add header lines
    for (int i = 0; i < header.Count; i++)
    {
      string line = header[i] + "\n";  // add a new line character
      code += line;
    }

    // Keep track of how much we have extruded
    double accumulatedExtrusion = 0;

    // We need to go to the first point of the first toolpath,
    // without extruding:
    Point3d startPt = toolPaths[0][0];

    // this is just to round the input numbers to the nearest 3 digits
    double startX = Math.Round(startPt.X, 3);
    double startY = Math.Round(startPt.Y, 3);
    double startZ = Math.Round(startPt.Z, 3);

    // compose the line and add it to the program
    string startLine = "G0 F" + startFR + " X" + startX + " Y" + startY + " Z" + startZ + "\n";
    code += startLine;

    // Let's iterate over all toolpaths
    for (int j = 0; j < toolPaths.Count; j++)
    {
      // Retrieve toolpath parameters
      Polyline toolPath = toolPaths[j];
      bool extruding = isExtruding[j];
      int feedRate = feedRates[j];
      string pattern = patterns[j];


      // Since the last point of the previous toolpath should coincide
      // with the beginning of the next, we skip the first point when
      // iterating over the polyline points
      for (int i = 1; i < toolPath.Count; i++)
      {
        // we can reuse the variables we declared before
        Point3d pt = toolPath[i];
        double X = Math.Round(pt.X, 3);
        double Y = Math.Round(pt.Y, 3);
        double Z = Math.Round(pt.Z, 3);

        if (extruding && (pattern == "continuous"))
        {
          // Every point after the first we need to measure the distance and calculate how
          // much material to extrude while moving to the target point
          double dist = pt.DistanceTo(toolPath[i - 1]);
          double extrude = dist * extrusionRate;

          // always add your extrusion distance to the current extruder position
          accumulatedExtrusion += extrude;
          double e = Math.Round(accumulatedExtrusion, 5); // round position to the nearest 5 digits

          // compose the line and add it to the program
          string line = "G1 F" + feedRate + " X" + X + " Y" + Y + " Z" + Z + " E" + e + "\n";
          code += line;
        }
        else if(extruding && (pattern == "dash"))
        {
          // Every point after the first we need to measure the distance and calculate how
          // much material to extrude while moving to the target point
          double dist = pt.DistanceTo(toolPath[i - 1]);
          if(i % 2 == 0)
          {
            double extrude = dist * extrusionRate1;
            accumulatedExtrusion += extrude;
          }
          else
          {
            double extrude = dist * extrusionRate2;
            accumulatedExtrusion += extrude;
          }

          // always add your extrusion distance to the current extruder position
          //accumulatedExtrusion += extrude;
          double e = Math.Round(accumulatedExtrusion, 5); // round position to the nearest 5 digits

          // compose the line and add it to the program
          string line = "G1 F" + feedRate + " X" + X + " Y" + Y + " Z" + Z + " E" + e + "\n";
          code += line;
        }
        else
        {
          // compose the line and add it to the program
          string line = "G0 F" + feedRate + " X" + X + " Y" + Y + " Z" + Z + "\n";
          code += line;
        }
      }
    }

    // Add footer lines
    for (int i = 0; i < footer.Count; i++)
    {
      string line = footer[i] + "\n";  // add a new line character
      code += line;
    }

    GCodeOut = code;

    //string folder = Environment.GetFolderPath(Environment.SpecialFolder.Desktop);

    //string filepath = Path.Combine(folder, filename + ".gcode");

    //if(save == true){
    //File.WriteAllText(filepath, code);
    //}
# ---------- end c_gcode_compilation ----------
panel_8 = Panel(c_gcode_compilation.GCodeOut)
c_gcode = CSharpScript(gCode=c_gcode_compilation.GCodeOut, folder=panel_4, filename="Base_C", save=save)  # -> out, msg; inputs startCode: String, gCode: String, endCode: String, folder: String, save: Boolean
# ---------- c_gcode: C# usings ----------
using System.IO;
# ---------- c_gcode: C# ----------
    // Concatenate your Gcode
    string gcode =
      startCode + "\n" +
      gCode +
      endCode;

    msg = gcode;

    // Create the filepath to save the gcode to
    // In this case we are saving to the desktop
    //string folder = Environment.GetFolderPath(Environment.SpecialFolder.Desktop);

    string filepath = Path.Combine(folder, filename + ".gcode");

    if(save == true){
      File.WriteAllText(filepath, gcode);
    }
# ---------- end c_gcode ----------
panel_9 = Panel(c_gcode.msg)
